# Grasshopper definition 001_MeshEdit.gh (Grasshopper 1.0.7)
# plug-ins: MeshEdit Components, Bifocals

# Wickerson's Favorite .gh Scripts
# from MESH EDIT
number_slider = Slider(1, range=0..1)
number_slider_2 = Slider(2, range=0..10)
number_slider_3 = Slider(2, range=0..10)
number_slider_4 = Slider(2, range=0..10)
construct_point = ConstructPoint(XCoordinate=number_slider, YCoordinate=number_slider, ZCoordinate=0)
domain_box = DomainBox(Base=PlaneXY(0, 0, 0), X=number_slider, Y=number_slider, Z=number_slider)
box_array = BoxArray(Geometry=construct_point, Cell=domain_box, XCount=number_slider_2, YCount=number_slider_3, ZCount=number_slider_4)  # -> Geometry, Transform
mesh_box = MeshBox(Base=domain_box, XCount=number_slider_2, YCount=number_slider_3, ZCount=number_slider_4)
panel = Panel(box_array.Geometry)
mesh_weldvertices = MeshWeldVertices(Mesh=mesh_box, Tolerance=0.01)  # -> RuntimeMessage, Mesh
populate_3d = Populate3D(Region=mesh_weldvertices.Mesh, Count=Slider(40, range=0..40), Seed=1)  # -> flatten(Population)
data_dam = DataDam(DataA=populate_3d, BufferDelay=10000000, BufferMode=0)
point = Point(flatten(data_dam))
element = Slider(4, range=0..100)
deconstruct_mesh = DeconstructMesh(Mesh=mesh_weldvertices.Mesh)  # -> Vertices, Faces, Colours, Normals
_3d_convexhull = _3DConvexHull(Points=point, Plankton=False, PlanktonMesh=False)
panel_2 = Panel(mesh_weldvertices.RuntimeMessage)
convex_hull_points = ConvexHullPoints(Points=point, _3D=True)  # -> ConvexHull, Indices
bounding_box = BoundingBox(Content=point, Plane=PlaneXY(0, 0, 0), UnionBox=True)  # -> Box, Box_2
panel_3 = Panel(deconstruct_mesh.Vertices)
_3d_delaunay = _3DDelaunay(Points=point)  # -> TopologicalEdges, Connectivity
_3d_delaunaycell = _3DDelaunayCell(Points=point, PlanktonMesh=False)  # -> _3DDelaunayCells, CellIndices
_3d_voronoi = _3DVoronoi(Points=point, Boundingbox=bounding_box.Box, Plankton=False, PlanktonMesh=False, WeldMesh=False, weld=False)  # -> _3DVoronoiCells, Connectivity
format = Format(Format="{0};{1}", Culture=1033, Data0=Slider(0, range=0..100), Data1=element)
tree_branch = TreeBranch(Tree=_3d_delaunaycell.CellIndices, Path=format, MaintainPaths=True)
tree_branch_2 = TreeBranch(Tree=_3d_voronoi._3DVoronoiCells, Path=format, MaintainPaths=True)
tree_branch_3 = TreeBranch(Tree=_3d_voronoi.Connectivity, Path=format, MaintainPaths=True)
mesh = Mesh(_3d_delaunaycell._3DDelaunayCells)
curve = Curve(_3d_delaunay.TopologicalEdges)
list_item = ListItem(List=point, Index=tree_branch_3, Wrap=True)
list_item_2 = ListItem(List=point, Index=tree_branch, Wrap=True)
curve_2 = Curve(tree_branch_2)
tree_branch_4 = TreeBranch(Tree=_3d_delaunay.Connectivity, Path=format, MaintainPaths=True)
list_item_3 = ListItem(List=point, Index=element, Wrap=True)
list_item_4 = ListItem(List=point, Index=tree_branch_4, Wrap=True)
line = Line(StartPoint=list_item_4, EndPoint=list_item_3)
