# Grasshopper definition 002_LUNCHBOX.gh (Grasshopper 1.0.7)
# plug-ins: LunchBoxML, Bifocals

# Wickerson's Favorite .gh Scripts
# from PROVING GROUND
# Gaussian Mixture
# Version:  2017.07.27
# Company Info: Authored by Proving Ground
# 
# http://ProvingGround.io
# Copyright (c) 2017 Proving Ground LLC
point = Point([Point(36.37578333, 11.345662, 0), Point(32.03957431, 13.62217174, 0), Point(33.12362656, 17.19954419, 0), Point(38.11026694, 17.84997554, 0), Point(39.30272442, 21.10213231, 0), Point(46.13225364, 17.09113896, 0)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])

# ---- group: Input Data
deconstruct = Deconstruct(Point=point)  # -> XComponent, YComponent, ZComponent
panel = Panel(deconstruct.XComponent)
panel_2 = Panel(deconstruct.YComponent)
entwine = Entwine(Branch00=panel, Branch01=panel_2, FlattenInputs=True)
flip_matrix = FlipMatrix(Data=entwine)

# ----
gaussian_mixture = GaussianMixture(TrainingInputs=flip_matrix, Components=Slider(5, range=0..10), RandomSeed=Slider(-7, range=-10..10))  # -> Result, Likelihood, Probability
sphere = Sphere(Base=point, Radius=1)

# ---- group: Result Plot
create_set = CreateSet(List=gaussian_mixture.Result)  # -> Set, Map
list_length = ListLength(List=create_set.Set)
gradient = Gradient(
    LowerLimit=0,
    UpperLimit=list_length,
    Parameter=create_set.Map,
    stops=[0: RGB(243, 57, 0), 0.1: RGB(236, 27, 60), 0.2: RGB(210, 0, 118), 0.3: RGB(103, 0, 120), 0.4: RGB(39, 72, 161), 0.5: RGB(1, 192, 229), 0.6: RGB(18, 178, 90), 0.7: RGB(79, 186, 8), 0.8: RGB(220, 237, 32), 0.9: RGB(247, 159, 20), 1: RGB(243, 57, 0)])
split_argb = SplitARGB(Colour=gradient, IntegerChannels=True)  # -> Alpha, Red, Green, Blue
colour_rgb = ColourRGB(Alpha=Slider(122, range=0..255), Red=split_argb.Red, Green=split_argb.Green, Blue=split_argb.Blue)
custom_preview = CustomPreview(Geometry=sphere, Shader=colour_rgb)

# ----
panel_3 = Panel(gradient)
