# Grasshopper definition 003_LUNCHBOX.gh (Grasshopper 1.0.7)
# plug-ins: LunchBoxML, Human, Bifocals

# ---- group: Input points
point = Point([Point(48.85484087, 42.93944115, 0), Point(47.54230675, 39.26946931, 0), Point(46.48351837, 36.27833523, 0), Point(17.5074815, 13.16084453, 0), Point(31.61152177, 22.39151598, 0), Point(36.3971641, 22.07227592, 0)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])
deconstruct = Deconstruct(Point=point)  # -> XComponent, YComponent, ZComponent
custom_preview = CustomPreview(Geometry=point, Shader=ColourSwatch(SwatchColor=RGB(255, 0, 115)))

# ---- group: X Test
# Wickerson's Favorite .gh Scripts
# from LUNCHBOX
# Linear Regression
# Version:  2017/07/21
# Company Info: Authored by Proving Ground
# 
# http://ProvingGround.io
# Copyright (c) 2017 Proving Ground LLC
series = Series(Start=0, Step=5, Count=10)

# ----
linear_regression = LinearRegression(TestData=series, TrainingInputs=deconstruct.XComponent, TrainingOutput=deconstruct.YComponent, RandomSeed=5)

# ---- group: LIne Plot
construct_point = ConstructPoint(XCoordinate=series, YCoordinate=linear_regression, ZCoordinate=0)
polyline = PolyLine(Vertices=construct_point, Closed=False)
custom_preview_lineweights = CustomPreviewLineweights(Geometry=polyline, Shader=ColourSwatch(SwatchColor=RGB(29, 74, 255)), Thickness=Slider(4, range=0..10), Absolute=False)
