# Grasshopper definition 004_ANEMONE.gh (Grasshopper 1.0.7)
# plug-ins: Bifocals, Anemone

# Anemone Loops with Remote
number_slider = Slider(0, range=0..10)
populate_2d = Populate2D(
    Region={Plane=PlaneXY(82.5, 49, 0), Size=Domain2(u=-320.5..320.5, v=-273..273)},
    Count=Slider(7, range=0..10),
    Seed=Slider(370, range=0..1000))
populate_2d_2 = Populate2D(Region={Plane=PlaneXY(82.5, 49, 0), Size=Domain2(u=-320.5..320.5, v=-273..273)}, Count=number_slider, Seed=1)
loop_start = LoopStart(Repeat=Slider(12817, range=0..100000), Data=populate_2d_2)  # -> port, Counter, Data
spin_force = SpinForce(Plane=populate_2d, Strength=Slider(677, range=0..1100), Radius=Slider(1.7, range=0..10), Decay=2)
merge_fields = MergeFields(Fields=spin_force)
evaluate_field = EvaluateField(Field=merge_fields, Point=loop_start.Data)  # -> Tensor, Strength
amplitude = Amplitude(Vector=evaluate_field.Tensor, Amplitude=Slider(10, range=0..110))
move = Move(Geometry=loop_start.Data, Motion=amplitude)  # -> Geometry, Transform

# ---- group: Loop End
running = Running(port=loop_start.port, Exit=False, Data=move.Geometry, TimeOutVal=0, pausedState=False, state="Constant & Record")

# ----
flip_matrix = FlipMatrix(Data=running)
polyline = PolyLine(Vertices=flip_matrix, Closed=False)
msphere = MeshSphere(Base=flip_matrix, Radius=10, UCount=10, VCount=20)
