# Grasshopper definition 005_LUNCHBOX.gh (Grasshopper 1.0.7)
# plug-ins: LunchBoxML, MeshEdit Components, Bifocals

# ---- group: Sample Points
number_slider = Slider(13, range=0..50)
# Company Info: Authored by Proving Ground
# 
# http://ProvingGround.io
# Copyright (c) 2017 Proving Ground LLC
panel = Panel("0 to 30")
random = Random(Range="0 to 5", Number=number_slider, Seed="10")
random_2 = Random(Range=panel, Number=number_slider, Seed="8")
random_3 = Random(Range=panel, Number=number_slider, Seed="5")
construct_point = ConstructPoint(XCoordinate=random_3, YCoordinate=random_2, ZCoordinate=random)
entwine = Entwine(Branch00=random_3, Branch01=random_2, FlattenInputs=True)
flip_matrix = FlipMatrix(Data=entwine)
dot_display = DotDisplay(Point=construct_point, Colour=ColourSwatch(SwatchColor=RGB(255, 0, 115)), Size=Slider(0.724, range=0..1))

# ---- group: Test Points
# Wickerson's Favorite .gh Scripts
# from LUNCHBOX
# Nonlinear Regression
# Version:  2017.7.27
number_slider_2 = Slider(26, range=0..50)
range = Range(Domain=panel, Steps=number_slider_2)
range_2 = Range(Domain=panel, Steps=number_slider_2)
cross_reference = CrossReference(ListA=range, ListB=range_2, CrossMode=1)  # -> ListA, ListB
entwine_2 = Entwine(Branch00=cross_reference.ListA, Branch01=cross_reference.ListB, FlattenInputs=True)
flip_matrix_2 = FlipMatrix(Data=entwine_2)

# ----
sigma = Slider(4.427, range=0..50)
nonlinear_regression = NonlinearRegression(TestData=flip_matrix_2, TrainingInputs=flip_matrix, TrainingOutput=random, Degree=sigma, Complexity=100, RandomSeed=5)  # -> Result, Score, Error

# ---- group: Prediction Points
construct_point_2 = ConstructPoint(XCoordinate=cross_reference.ListA, YCoordinate=cross_reference.ListB, ZCoordinate=flatten(nonlinear_regression.Result))
custom_preview = CustomPreview(Geometry=construct_point_2, Shader=ColourSwatch(SwatchColor=RGB(155, 97, 255)))

# ----
surface_from_points = SurfaceFromPoints(Points=construct_point_2, UCount=expr("x+1", number_slider_2), Interpolate=False)
mesh_frompoints = MeshFromPoints(Points=construct_point_2, UDirection=expr("x+1", number_slider_2), VDirection=expr("x+1", number_slider_2))
