# Grasshopper definition 006_OCTREE.gh (Grasshopper 1.0.7)
# plug-ins: Bifocals

# Wickerson's Favorite .gh Scripts
# from OCTREE (parametrichouse)
number_slider = Slider(61.8, range=0..100)
center_box = CenterBox(Base=PlaneXY(0, 0, 0), X=number_slider, Y=Slider(70.8, range=0..100), Z=Slider(87.4, range=0..100))
populate_geometry = PopulateGeometry(Geometry=center_box, Count=Slider(20, range=0..400), Seed=Slider(1231, range=0..10000))
octree = OcTree(Points=populate_geometry, Square=Toggle(True), Group=Slider(1, range=0..100))  # -> Boxes, Points
box = Box(octree.Boxes)
random_reduce = RandomReduce(List=box, Reduction=Slider(89, range=0..100), Seed=1)
custom_preview = CustomPreview(
    Geometry=random_reduce,
    Material={diffuse=RGB(221, 160, 221), emission=RGB(66, 48, 66), shine=0.5, specular=RGB(255, 255, 255), transparency=0})
