# Grasshopper definition 007_EVALCRV.gh (Grasshopper 1.0.7)
# plug-ins: Bifocals

point = Point(Point(47.95391257, -39.38963451, 0))
point_2 = Point([Point(89.89835264, 12.22644091, -0.4978057398), Point(96.44231546, -95.96149991, 28.74500123), Point(-67.14020791, -111.0608554, 0), Point(-10.09201583, 61.68797799, 0)])
nurbs_curve = NurbsCurve(Vertices=point_2, Degree=3, Periodic=True)  # -> reparameterize(Curve), Length, Domain
# Wickerson's Favorite .gh Scripts
# from EVALCRV (parametrichouse)
number_slider = Slider(690, range=0..1000)
curve = Curve(nurbs_curve.Curve)
number_slider_2 = Slider(200, range=0..200)
domain = Domain(nurbs_curve.Domain)
evaluate_curve = EvaluateCurve(Curve=reparameterize(curve), Parameter=Slider(0.235, range=0..1))  # -> Point, Tangent, Angle
panel = Panel(domain)
construct_domain = ConstructDomain(DomainStart=0, DomainEnd=number_slider)
multiplication = Multiplication(A=evaluate_curve.Tangent, B=Slider(80, range=0..100))
range = Range(Domain=construct_domain, Steps=number_slider_2)
range_2 = Range(Domain=Domain(0, 1), Steps=number_slider_2)
graph_mapper = GraphMapper(range_2, x0=0, x1=1, y0=0, y1=1, container_name="Sine", Equation_px=[0, 0.9770666957], Equation_py=[0, 0.7798813581])
vector_display = VectorDisplay(Anchor=evaluate_curve.Point, Vector=multiplication)
remap = Remap(data=graph_mapper, min=Slider(1, range=0..1), max=Slider(0.01, range=0..0.01))
rotate_3d = Rotate3D(Geometry=curve, Angle=expr("-x", degrees(range)), Center=point, Axis=evaluate_curve.Tangent)  # -> Geometry, Transform
number = Number([Slider(0.9, range=0.9..1.1), Slider(0.9, range=0.9..1.1), Slider(1.1, range=0.9..1.1), Slider(1.1, range=0.9..1.1)])
scale = Scale(Geometry=rotate_3d.Geometry, Center=point, Factor=remap)  # -> Geometry, Transform
repeat_data = RepeatData(Data=number, Length=expr("x+1", number_slider_2))
scale_2 = Scale(Geometry=scale.Geometry, Center=point, Factor=repeat_data)  # -> Geometry, Transform
loft = Loft(
    Curves=scale_2.Geometry,
    Options={Adjust=False, Closed=False, LoftEnds=0, LoftSimp=0, LoftType=0, Rebuild=10, Refit=0.01})

# ==== cluster Remap: Remaps numbers
data = ClusterInput()
min = ClusterInput()
max = ClusterInput()
bnd = Bounds(Numbers=data)
dom = ConstructDomain(DomainStart=min, DomainEnd=max)
remap = RemapNumbers(Value=data, Source=bnd, Target=dom)  # -> Mapped, Clipped
R = ClusterOutput(remap.Mapped)
