# Grasshopper definition 008_VORONOI3D.gh (Grasshopper 1.0.7)
# plug-ins: Bifocals

# Wickerson's Favorite .gh Scripts
# from VORONOI3D (parametrichouse)
box = Box({Plane=PlaneXY(-36, -19, 0), X=Domain(0, 30), Y=Domain(0, 55), Z=Domain(0, 17)})
point = Point([Point(-36, -19, 0), Point(-36, 36, 0), Point(-6, 24.45958227, 16.60397489), Point(-1.813228311, -5.401570817, -0.2540552989)])
sphere = Sphere(Base=point, Radius=Slider(15, range=0..20))
area = Area(Geometry=box)  # -> Area, Centroid
solid_difference = SolidDifference(BrepsA=box, BrepsB=sphere)
populate_geometry = PopulateGeometry(Geometry=solid_difference, Count=Slider(43, range=0..100), Seed=1)
scale = Scale(Geometry=solid_difference, Center=area.Centroid, Factor=Slider(1.261, range=0..2))  # -> Geometry, Transform
box_2 = Box(scale.Geometry)
voronoi_3d = Voronoi3D(Points=populate_geometry, Box=box_2)  # -> Cells, Boundary
solid_intersection = SolidIntersection(BrepsA=voronoi_3d.Cells, BrepsB=solid_difference)  # -> graft(Result)
brep_brep = BrepBrep(BrepA=voronoi_3d.Cells, BrepB=solid_difference)  # -> Curves, Points
solid_union = SolidUnion(Breps=solid_intersection)
deconstruct_brep = DeconstructBrep(Brep=solid_union)  # -> flatten(Faces), Edges, Vertices
surface = Surface(deconstruct_brep.Faces)
number_slider = Slider(0.82, range=0..1)
area_2 = Area(Geometry=surface)  # -> Area, Centroid
curve = Curve(surface)
scale_2 = Scale(Geometry=curve, Center=area_2.Centroid, Factor=number_slider)  # -> Geometry, Transform
curve_2 = Curve(graft(curve))
curve_3 = Curve(graft(scale_2.Geometry))
scale_3 = Scale(Geometry=surface, Center=area_2.Centroid, Factor=number_slider)  # -> Geometry, Transform
loft = Loft(
    Curves=[curve_3, curve_2],
    Options={Adjust=False, Closed=False, LoftEnds=0, LoftSimp=0, LoftType=0, Rebuild=10, Refit=0.01})
