# Grasshopper definition 009_TREE8.gh (Grasshopper 1.0.7)
# plug-ins: Tree8, Bifocals

# ----
# Planes for floors
slider = Slider(7, range=3..7)
series = Series(Start=0, Step=Slider(5, range=5..10), Count=slider)
unit_z = UnitZ(Factor=series)
xy_plane = XYPlane(Origin=unit_z)

# ----
# XY Grid for Boxes
slider_2 = Slider(5, range=5..10)
slider_3 = Slider(5, range=3..7)
plane = Plane(xy_plane)
slider_4 = Slider(0.6, range=0..1)
rectangular = Rectangular(Plane=plane, SizeX=slider_2, SizeY=Slider(5, range=5..10), ExtentX=Slider(4, range=3..7), ExtentY=slider_3)  # -> Cells, Points
center_box = CenterBox(Base=rectangular.Points, X=slider_4, Y=slider_4, Z=slider_4)
data = Data(center_box)

# ----
# Wickerson's Favorite .gh Scripts
# from TREE8
# XY Grid for Boxes
slider_5 = Slider(5, range=5..10)
xy_plane_2 = XYPlane(Origin=Point(0, 0, 0))
slider_6 = Slider(0.6, range=0..1)
rectangular_2 = Rectangular(
    Plane=xy_plane_2,
    SizeX=slider_5,
    SizeY=Slider(5, range=5..10),
    ExtentX=Slider(4, range=3..7),
    ExtentY=Slider(5, range=3..7))  # -> Cells, Points
center_box_2 = CenterBox(Base=rectangular_2.Points, X=slider_6, Y=slider_6, Z=slider_6)

param_viewer = ParamViewer(data)

# ----
# flatten data tree
data_2 = Data(data)
param_viewer_2 = ParamViewer(data_2)
data_3 = Data(flatten(data_2))

# ----
# Basic Concept of First-End Components
data_4 = Data(center_box_2)
# Tree8 Smart First-End Component
# It is developed
# for managing the multi dimensional data tree
# with first-end algorithm.
# 
#  3  2  1 0  -1
# {0; 0; i; j} (k)
slider_7 = Slider(0, range=-3..4)
first_end_list = FirstEndList(Tree=data_4)  # -> FirstList, Remainders, EndList
param_viewer_3 = ParamViewer(data_4)
first_end_item = FirstEndItem(List=data_4)  # -> FirstItem, Remainders, EndItem
smart_first_end_data = SmartFirstEndData(Tree=data_4, Index=slider_7)  # -> FirstList, Remainders, EndList
smart_first_end_data_2 = SmartFirstEndData(Tree=data_4, Index=Slider(-1, range=-3..4))  # -> FirstList, Remainders, EndList
param_viewer_4 = ParamViewer(first_end_item.Remainders)
param_viewer_5 = ParamViewer(first_end_list.Remainders)
param_viewer_6 = ParamViewer(smart_first_end_data_2.Remainders)
param_viewer_7 = ParamViewer(smart_first_end_data.Remainders)

# ----
# Data Allocation with Numbers of Branches
# It groups boxes by levels in this case.
ez = Integer(slider)
data_5 = Data(data_3)
data_allocation_b = DataAllocationB(Data=data_5, NumberOfBranches=ez)
param_viewer_8 = ParamViewer(data_5)
param_viewer_9 = ParamViewer(data_allocation_b)

# ----
# Data Allocation with Numbers of Items
# It groups boxes by X grid in this case.
ey = Integer(expr("x+1", slider_3))
data_6 = Data(data_allocation_b)
data_allocation_n = DataAllocationN(Data=data_6, NumberOfItems=ey)
param_viewer_10 = ParamViewer(data_6)
param_viewer_11 = ParamViewer(data_allocation_n)

data_7 = Data(first_end_item.EndItem)
data_8 = Data(first_end_item.FirstItem)

data_9 = Data(first_end_list.FirstList)
data_10 = Data(first_end_list.EndList)

# ----
# Data Split Allocation with a list of Indices
# It groups levels to 3 zones in this case.
data_11 = Data(simplify(data_allocation_b))
tree_statistics = TreeStatistics(Tree=data_11)  # -> Paths, Length, Count
panel = Panel("""2
6""")
data_split_allocation = DataSplitAllocation(Data=tree_statistics.Paths, Indices=panel)
panel_2 = Panel(tree_statistics.Paths)
panel_3 = Panel(data_split_allocation)
tree_branch = TreeBranch(Tree=data_11, Path=data_split_allocation, MaintainPaths=False, SplitTree=True)
tree_branch_2 = TreeBranch(Tree=data_11, Path=data_split_allocation, MaintainPaths=True, SplitTree=True)
param_viewer_12 = ParamViewer(tree_branch_2)
param_viewer_13 = ParamViewer(tree_branch)
shift_paths = ShiftPaths(Data=tree_branch_2, Offset=-1)
param_viewer_14 = ParamViewer(shift_paths)

explode_tree = ExplodeTree(Data=shift_paths)  # -> Branch0, Branch1, Branch2
data_12 = Data(explode_tree.Branch2)
data_13 = Data(explode_tree.Branch0)

data_14 = Data(explode_tree.Branch1)

# ----
# index > 1 (meaningless path index in this case)
# it preforms like First-End List.
slider_8 = Slider(2, range=-3..4)
data_15 = Data(data)
smart_first_end_data_3 = SmartFirstEndData(Tree=data_15, Index=slider_8)  # -> FirstList, Remainders, EndList
param_viewer_15 = ParamViewer(smart_first_end_data_3.Remainders)

data_16 = Data(smart_first_end_data_3.EndList)
data_17 = Data(smart_first_end_data_3.FirstList)

param_viewer_16 = ParamViewer(data_17)
param_viewer_17 = ParamViewer(data_16)

# ----
# Index < 0
# It performs like First-End Item.
slider_9 = Slider(-1, range=-3..4)
data_18 = Data(data)
smart_first_end_data_4 = SmartFirstEndData(Tree=data_18, Index=slider_9)  # -> FirstList, Remainders, EndList
param_viewer_18 = ParamViewer(smart_first_end_data_4.Remainders)

data_19 = Data(smart_first_end_data_4.FirstList)
data_20 = Data(smart_first_end_data_4.EndList)

param_viewer_19 = ParamViewer(data_19)
param_viewer_20 = ParamViewer(data_20)

data_21 = Data(smart_first_end_data_4.Remainders)
data_22 = Data(smart_first_end_data_4.EndList)
data_23 = Data(data_19)
custom_preview = CustomPreview(Geometry=data_21, Shader=ColourSwatch(SwatchColor=RGBA(107, 214, 90, 90)))
custom_preview_2 = CustomPreview(Geometry=data_22, Shader=ColourSwatch(SwatchColor=RGB(51, 103, 245)))
custom_preview_3 = CustomPreview(Geometry=data_23, Shader=ColourSwatch(SwatchColor=RGB(240, 24, 24)))

# ----
# index = 1
# 1 is the second from the end and means Levels in this case
slider_10 = Slider(1, range=-3..4)
data_24 = Data(data)
smart_first_end_data_5 = SmartFirstEndData(Tree=data_24, Index=slider_10)  # -> FirstList, Remainders, EndList
param_viewer_21 = ParamViewer(smart_first_end_data_5.Remainders)

data_25 = Data(smart_first_end_data_5.FirstList)
data_26 = Data(smart_first_end_data_5.EndList)

param_viewer_22 = ParamViewer(data_25)
param_viewer_23 = ParamViewer(data_26)

# ----
# index = 0
# 0 is the last path index and means X grid in this case
slider_11 = Slider(0, range=-3..4)
data_27 = Data(data)
smart_first_end_data_6 = SmartFirstEndData(Tree=data_27, Index=slider_11)  # -> FirstList, Remainders, EndList
param_viewer_24 = ParamViewer(smart_first_end_data_6.Remainders)

data_28 = Data(smart_first_end_data_6.FirstList)
data_29 = Data(smart_first_end_data_6.EndList)

param_viewer_25 = ParamViewer(data_28)
param_viewer_26 = ParamViewer(data_29)
