# Grasshopper definition 021_BUCHMAN.gh (Grasshopper 1.0.7)
# plug-ins: Bifocals

# Wickerson's Favorite .gh Scripts
# from BUCHMAN
circle = Circle(Plane=PlaneXY(0, 0, 0), Radius=1)
perp_frames = PerpFrames(Curve=circle, Count=10, Align=True)  # -> Frames, Parameters
circle_2 = Circle(Plane=perp_frames.Frames, Radius=1)
divide_curve = DivideCurve(Curve=circle_2, Count=10, Kinks=False)  # -> Points, Tangents, Parameters
series = Series(Start=0, Step=Slider(-1, range=-1..2), Count=10)
shift_list = ShiftList(List=divide_curve.Points, Shift=graft(series), Wrap=True)
loft = Loft(Curves=circle_2, Options={Adjust=False, Closed=True, LoftEnds=0, LoftSimp=0, LoftType=0, Rebuild=10, Refit=0.01})
flip_matrix = FlipMatrix(Data=shift_list)
surface_closest_point = SurfaceClosestPoint(Point=flip_matrix, Surface=loft)  # -> Point, UVPoint, Distance
interpolate = Interpolate(Vertices=flip_matrix, Degree=3, Periodic=True, KnotStyle=1)  # -> Curve, Length, Domain
curve_closest_point = CurveClosestPoint(Point=flip_matrix, Curve=interpolate.Curve)  # -> Point, Parameter, Distance
number_slider = Slider(0.075, range=0..1)
evaluate_surface = EvaluateSurface(Surface=loft, Point=surface_closest_point.UVPoint)  # -> Point, Normal, UDirection, VDirection, Frame
evaluate_curve = EvaluateCurve(Curve=interpolate.Curve, Parameter=curve_closest_point.Parameter)  # -> Point, Tangent, Angle
multiplication = Multiplication(A=number_slider, B=Slider(1.286, range=0..10))
cross_product = CrossProduct(VectorA=evaluate_surface.Normal, VectorB=evaluate_curve.Tangent, Unitize=False)  # -> Vector, Length
negative = Negative(Value=number_slider)
negative_2 = Negative(Value=multiplication)
construct_domain = ConstructDomain(DomainStart=number_slider, DomainEnd=negative)
construct_domain_2 = ConstructDomain(DomainStart=multiplication, DomainEnd=negative_2)
construct_plane = ConstructPlane(Origin=evaluate_surface.Point, XAxis=evaluate_surface.Normal, YAxis=cross_product.Vector)
rectangle = Rectangle(Plane=construct_plane, XSize=construct_domain, YSize=construct_domain_2, Radius=0)  # -> Rectangle, Length
loft_2 = Loft(
    Curves=rectangle.Rectangle,
    Options={Adjust=False, Closed=True, LoftEnds=0, LoftSimp=0, LoftType=0, Rebuild=10, Refit=0.01})
