# Grasshopper definition 022_WEAVERBIRD.gh (Grasshopper 1.0.7)
# plug-ins: Weaverbird, Bifocals

# ---- group: a starting mesh
sides = Slider(6, range=3..12)
sides_2 = Slider(4, range=3..7)
weaverbird_s_mesh_prism = MeshPrism(
    Plane=PlaneXY(0, 0, 0),
    Width=sides,
    NumberOfSides=sides_2,
    TopPoint=Point(0, 0, 10),
    BasePolygonMethod=True,
    FillStrategy=1)
level = Slider(1, range=0..4)
use_unit_offset_false_of_edge = BooleanToggle(False)
weaverbird_s_catmull_clark_subdivision = CatmullClarkSubdivision(MeshCurves=weaverbird_s_mesh_prism, Level=level, SmoothNakedEdges=0)
offset = Slider(13.8299, range=0.01..16)
weaverbird_s_picture_frame = PictureFrame(MeshPolylines=weaverbird_s_catmull_clark_subdivision, Distance=offset, OffsetType=use_unit_offset_false_of_edge)

# ----
wb = ImageSampler(Filter="Colour", Interpolate=False, Umax=1, Umin=0, Vmax=1, Vmin=0, Wrap=1)
# This release of Wb contains a few definitions (you can find more in the example folder) and can be installed via Yak. Just use Rhino 6 to be able to download it from the server. Before using it, you must accept the license agreement.
# 
# NOTE: On most machines, you will need to restart Rhino for the Yak installation of WB to take effect!
image_sampler = ImageSampler(Filter="Colour", Interpolate=False, Umax=1, Umin=0, Vmax=1, Vmin=0, Wrap=1)
boolean_toggle = BooleanToggle(False)
delaunay_mesh = DelaunayMesh(
    Points=[Point(67, 12, 0), Point(57, -2, 0), Point(65, -16, 0), Point(98, -25, 0), Point(111, -4, 0), Point(123, 20, 0), Point(105, 34, 0), Point(83, 26, 0), Point(74, 4, -9), Point(86, -2, -8), Point(98, -7, -7), Point(104, -11, -5), Point(110, -12, -5), Point(102, 1, 10), Point(95, 8, 10), Point(84, 7, 12)],
    Plane=PlaneXY(0, 0, 0))
# for Yak and Mac
# 
# v 0.9.0.1
panel = Panel("Weaverbird")
weaverbird_s_loop_subdivision = LoopSubdivision(MeshCurves=delaunay_mesh, Level=2, SmoothNakedEdges=boolean_toggle)

# ---- group: coloring
colour_swatch = ColourSwatch(SwatchColor=RGB(120, 120, 120))
colour_swatch_2 = ColourSwatch(SwatchColor=RGB(255, 255, 255))
colour_swatch_3 = ColourSwatch(SwatchColor=RGB(255, 0, 0))
colour_swatch_4 = ColourSwatch(SwatchColor=RGB(255, 250, 163))

# ---- group: a group of curves
hexagonal = Hexagonal(Plane=PlaneXY(-10.55213976, 5.665637213, 0), Size=2, ExtentX=9, ExtentY=16)  # -> Cells, Points
circular_arc = CircularArc([{Angle=0, Angle=3.08734986, Plane=Plane(origin=(0, -12.87936404, 0.1365836204), x=(0.9999775253, 0, -0.006704395413), y=(0.006704395413, 0, 0.9999775253)), Radius=28.95298645}, {Angle=0, Angle=3.028209025, Plane=Plane(origin=(-0.4569871354, 16.87870354, 0), x=(0.9997330863, 0, 0.02310316181), y=(-0.02310316181, 0, 0.9997330863)), Radius=14.60370525}, {Angle=0, Angle=2.907187234, Plane=Plane(origin=(9.118104545, 29.47828606, 0), x=(0.9987275845, 0, 0.05043026813), y=(-0.05043026813, 0, 0.9987275845)), Radius=14.5212827}, {Angle=0, Angle=2.899501929, Plane=Plane(origin=(4.504817082, 62.81561779, 0), x=(0.9995247492, 0, 0.03082654193), y=(-0.03082654193, 0, 0.9995247492)), Radius=35.99093035}])
loft = Loft(Section=circular_arc, Options={Adjust=False, Closed=False, LoftEnds=0, LoftSimp=1, LoftType=1, Rebuild=10, Refit=0.01})
project = Project(Curve=hexagonal.Cells, Brep=loft, Direction=Vector(0, 0, 1))
flatten_tree = FlattenTree(Data=project, Path="{0}")

# ----
polyline = PolyLine(
    Vertices=[Point(12, -31, 0), Point(11, -23, 0), Point(19, -19, 0), Point(27, -22, 0), Point(27, -27, 0), Point(22, -32, 0), Point(12, -31, 0)],
    Closed=True)
polyline_2 = PolyLine(Vertices=[Point(12, -31, 0), Point(11, -23, 0), Point(0, -23, 0), Point(2, -33, 0), Point(12, -31, 0)], Closed=True)
polyline_3 = PolyLine(
    Vertices=[Point(3, -44, 0), Point(2, -33, 0), Point(12, -31, 0), Point(22, -32, 0), Point(21, -40, 0), Point(14, -46, 0), Point(3, -44, 0)],
    Closed=True)
weaverbird_s_vertices_component = VerticesComponent(Mesh=weaverbird_s_loop_subdivision, Weld=False)
pcomp = Decompose(Point=weaverbird_s_vertices_component)  # -> XComponent, YComponent, ZComponent
curve = Curve([polyline_3, polyline, polyline_2])
C = Colours([colour_swatch_3, colour_swatch_4, colour_swatch, colour_swatch_2])
mcomp = Decompose(Mesh=weaverbird_s_picture_frame)  # -> Vertices, Faces, Colours, Normals
weaverbird_s_mesh_edges = WeaverBirdsMeshEdges(MeshOrPolylines=curve)
mesh_plane = MeshPlane(Boundary={Plane=PlaneXY(-24, 4, 0), Size=Domain2(u=-7..7, v=-7..7)}, WidthCount=1, HeightCount=1)  # -> Mesh, Area
bounds = Bounds(Numbers=pcomp.ZComponent)

# ---- group: attractor
point = Point(Point(0.1766759545, -8.17539107, 4.048119619))

# ----
line = Line(Line((8, -51, 3), (26, -17, 4)))
distance = Distance(PointA=mcomp.Vertices, PointB=point)

# ---- group: offset
point_on_curve = PointOnCurve(line, parameter=0.451)

# ----
attractor_force = Slider(5, range=0..100)
domcomp = DomainComponents(Domain=bounds)  # -> Start, End
evaluate_length = EvaluateLength(Curve=weaverbird_s_mesh_edges, Length=0.5, Normalized=True)  # -> Point, Tangent, Parameter

# ---- group: find discontinuities
discontinuity = Discontinuity(Curve=flatten_tree, Level=1)  # -> Points, Parameters

# ----
division = Division(A=1, B=distance)
multiplication = Multiplication(A=division, B=attractor_force)
final_double_smooth_pass = Slider(2, range=0..4)
weaverbird_s_mesh_thicken = Thicken(MeshCurves=weaverbird_s_picture_frame, Distance=multiplication, OffsetType=0)

# ---- group: Colored t
gradient = Gradient(
    LowerLimit=domcomp.Start,
    UpperLimit=domcomp.End,
    Parameter=pcomp.ZComponent,
    stops=[0.00648: RGB(0, 0, 192), 0.449: RGB(0, 255, 255), 0.569: RGB(221, 255, 53), 0.893: RGB(240, 183, 82), 1: RGB(255, 255, 255)])
mesh_colours = MeshColours(Mesh=weaverbird_s_loop_subdivision, Colours=gradient)
# 4
# 
# A terrain mesh is generated from a few points and then vertex-colored
weaverbird_s_loop_subdivision_2 = LoopSubdivision(MeshCurves=mesh_colours, Level=3, SmoothNakedEdges=boolean_toggle)

# ----
mesh_colours_2 = MeshColours(Mesh=mesh_plane.Mesh, Colours=C)

# ---- group: make polylines
polyline_4 = PolyLine(Vertices=discontinuity.Points, Closed=False)

# ----
distance_2 = Distance(PointA=evaluate_length.Point, PointB=point_on_curve)
weaverbird_s_catmull_clark_subdivision_2 = CatmullClarkSubdivision(MeshCurves=mesh_colours_2, Level=3, SmoothNakedEdges=0)
weaverbird_s_catmull_clark_subdivision_3 = CatmullClarkSubdivision(MeshCurves=weaverbird_s_mesh_thicken, Level=final_double_smooth_pass, SmoothNakedEdges=1)
# From this version of Wb, most subdivision
# components accept polylines as inputs.
# They automatically convert them into meshes.
# Here how we could smoothen an hexagonal mesh.
weaverbird_s_catmull_clark_subdivision_4 = CatmullClarkSubdivision(MeshCurves=flatten(polyline_4), Level=1, SmoothNakedEdges=1)
division_2 = Division(A=8, B=distance_2)
# 3
# 
# A simple attractor is used to show proximity to a point.
weaverbird_s_picture_frame_2 = WeaverBirdsPictureFrame(MeshPolylines=curve, Distance=division_2, InsetType=1)
weaverbird_s_laplacian_smoothing = LaplacianSmoothing(MeshCurves=weaverbird_s_catmull_clark_subdivision_3, Level=final_double_smooth_pass, SmoothNakedEdges=1, Thin=1)
# 1
# 
# A grid of hexagons is projected onto a surface and then subdivided. Wb subdivides also groups of curves.
# 2
# 
# Few mesh vertices are colored, then Wb's CC subd is applied to give a smooth gradient.
mesh_edges = MeshEdges(Mesh=weaverbird_s_catmull_clark_subdivision_4)  # -> NakedEdges, InteriorEdges, NonManifoldEdges

# ---- group: let's see the original
original = Move(Geometry=weaverbird_s_picture_frame, Translation=Vector(0, 38.0199113, 0))

# ----
# 5
# 
# A set of extruded polyhedra..
# 
# for more, see the sample folder!
move = Move(Geometry=weaverbird_s_mesh_thicken, Motion=Vector(0, 20, 0))  # -> Geometry, Transform
