# Grasshopper definition 023_HOOPSNAKE.gh (Grasshopper 1.0.7)
# plug-ins: Bifocals, HoopSnake

# Wickerson's Favorite .gh Scripts
# from HOOPSNAKE
number_slider = Slider(3, range=0..10)
hoopsnake = HoopSnake(
    StartingData=number_slider,
    Data=evaluate,
    TerminationCondition=Slider(100, range=0..100),
    Trigger=Toggle(False),
    Hoopsnake_Data_autoUpdate=False,
    Hoopsnake_Data_dataLimit=2147483647,
    Hoopsnake_Data_delay=0,
    Hoopsnake_Data_resetCounter=True,
    Hoopsnake_Data_updateView=True)  # -> Feedback, FeedbackHistory, LoopsCounter, IterationsCounter
evaluate = Evaluate(Expression="x*x", x=hoopsnake.Feedback)
param_viewer = ParamViewer(hoopsnake.FeedbackHistory)
panel = Panel(hoopsnake.Feedback)
panel_2 = Panel(hoopsnake.FeedbackHistory)
panel_3 = Panel(hoopsnake.IterationsCounter)
panel_4 = Panel(hoopsnake.LoopsCounter)
