# Grasshopper definition 024_FLEXHOPPER.gh (Grasshopper 1.0.7)
# plug-ins: FlexHopper, Bifocals

# ----
# Random Points
number_slider = Slider(100, range=0.001..200)
# Wickerson's Favorite .gh Scripts
# from FLEXHOPPER
number_slider_2 = Slider(559, range=1..10000)
construct_domain = ConstructDomain(DomainStart=expr("x*-1", number_slider), DomainEnd=number_slider)
random = Random(Range=construct_domain, Number=expr("x*3", number_slider_2), Seed=Slider(3, range=0..50))
partition_list = PartitionList(List=random, Size=3)
list_item = ListItem(List=partition_list, Index=0, Wrap=True)  # -> Item, Item1, Item2
addition = Addition(A=list_item.Item2, B=number_slider)
construct_point = ConstructPoint(XCoordinate=list_item.Item, YCoordinate=list_item.Item1, ZCoordinate=addition)  # -> flatten(Point)

panel = Panel(addition)
particles_from_points = ParticlesFromPoints(Positions=construct_point, SelfCollision=Toggle(True))
xy_plane = XYPlane(Origin=Point(0, 0, 0))
flex_scene = FlexScene(Particles=flatten(particles_from_points))
flex_collision_geometry = FlexCollisionGeometry(CollisionPlanes=flatten(xy_plane))
flex_solver_options = FlexSolverOptions(
    TimeStep=Slider(0.169, range=0..1),
    SubSteps=3,
    NumIterations=3,
    SceneMode=Slider(0, range=0..2),
    FixedNumberOfIteration=-1,
    MemoryRequirements=[131072, 96, 65536, 65536, 65536, 65536, 65536, 196608, 131972],
    StabilityScale=1)
flex_engine = FlexEngine(
    FlexCollisionGeometry=flex_collision_geometry,
    FlexScene=flatten(flex_scene),
    FlexSolverOptions=flex_solver_options,
    Reset=Button(),
    Go=Toggle(True))  # -> FlexObject, Information
panel_2 = Panel(flex_engine.Information)
get_all_particles = GetAllParticles(FlexObject=flex_engine.FlexObject, N=1)  # -> Points, Vector
