# Grasshopper definition 025_FLEXHOPPER.gh (Grasshopper 1.0.7)
# plug-ins: FlexHopper, Bifocals

xz = XZPlane(Origin=Point(0, 0, 0))
yz = YZPlane(Origin=Point(0, 0, 0))
rotate = Rotate(Geometry=xz, Angle=Slider(-1, range=-3.1415..3.1416), Plane=yz)  # -> Geometry, Transform
vec = VectorXYZ(XComponent=0, YComponent="100", ZComponent=0)  # -> Vector, Length
move = Move(Geometry=rotate.Geometry, Motion=vec.Vector)  # -> Geometry, Transform
rotate_2 = Rotate(Geometry=move.Geometry, Angle=[0, 1.570796327, 3.141592654, 4.71238898], Plane=PlaneXY(0, 0, 0))  # -> Geometry, Transform

xy = XYPlane(Origin=Point(0, 0, 0))

number_slider = Slider(55.217, range=0.001..200)
number_slider_2 = Slider(3, range=1..5)
dom = ConstructDomain(DomainStart=expr("x*-1", number_slider), DomainEnd=number_slider)
range = Range(Domain=dom, Steps=expr("x-1", number_slider_2))
random = Random(Range=Domain(0, 1), Number=expr("x*x*x*3", number_slider_2), Seed=2)
partition = PartitionList(List=random, Size=3)
addition = Addition(A=range, B=number_slider)
pt = ConstructPoint(XCoordinate=range, YCoordinate=graft(range), ZCoordinate=0)
Z = UnitZ(Factor=addition)
item = ListItem(List=partition, Index=0, Wrap=True)  # -> Item, Item1, Item2
move_2 = Move(Geometry=flatten(pt), Motion=graft(Z))  # -> flatten(Geometry), Transform
vec_2 = VectorXYZ(XComponent=item.Item, YComponent=item.Item1, ZComponent=item.Item2)  # -> flatten(Vector), Length
pl = PlaneNormal(Origin=move_2.Geometry, ZAxis=vec_2.Vector)

# ----
# Colliding Boxes
number_slider_3 = Slider(6.9, range=0..50)
box = CenterBox(Base=pl, X=number_slider_3, Y=number_slider_3, Z=number_slider_3)

pln = Plane([rotate_2.Geometry, xy])

# ----
# ACTIVATE ME!
toggle = BooleanToggle(False)
# Wickerson's Favorite .gh Scripts
# from FLEXHOPPER
number_slider_4 = Slider(60.4, range=0..500)
timer = Timer(Interval=200, TimerInterval=200, Target=fountain)  # disabled
vec_3 = VectorXYZ(XComponent=0, YComponent=0, ZComponent=Slider(79.62, range=0..300))  # -> Vector, Length
item_2 = ListItem(List=pln, Index=Slider(3, range=0..3), Wrap=True)
move_3 = Move(Geometry=item_2, Motion=vec_3.Vector)  # -> Geometry, Transform
fountain = ParticleFountain(
    OriginPlane=move_3.Geometry,
    ParticleCount=Slider(66, range=1..100),
    Diameter=number_slider_4,
    RandomDirectionRange=0,
    Velocity=Slider(50, range=0..50),
    RandomPositions=toggle)  # -> Points, Velocities
cir = Circle(Plane=move_3.Geometry, Radius=expr("x/2", number_slider_4))

panel = Panel(fountain.Points)
number_slider_5 = Slider(10, range=0.01..20)
number_slider_6 = Slider(8, range=0.01..10)
number_slider_7 = Slider(10, range=0..30)
number_slider_8 = Slider(4, range=0..10)
number_slider_9 = Slider(0, range=0..10)
particles = ParticlesFromPoints(Positions=fountain.Points, Velocities=fountain.Velocities, SelfCollision=Toggle(True), IsFluid=Toggle(True))

# ----
# SCENEMODE MATTERS
number_slider_10 = Slider(1, range=0..2)

parameters = FlexParametersFromValues(
    Gravity=Vector(0, 0, -9.81),
    Radius=number_slider_5,
    SolidRestDistance=0.15,
    FluidRestDistance=number_slider_6,
    CollisionDistance=number_slider_8,
    ParticleCollisionMargin=number_slider_7,
    ShapeCollisionMargin=number_slider_9,
    MaxSpeed=3.402823466e+38,
    MaxAcceleration=100,
    DynamicFriction=0,
    StaticFriction=0,
    ParticleFriction=0,
    Restitution=0,
    Adhesion=0,
    SleepThreshold=0,
    ShockPropagation=0,
    Dissipation=0,
    Damping=0,
    Fluid=True,
    Viscosity=0,
    Cohesion=0.025,
    SurfaceTension=0,
    SolidPressure=1,
    FreeSurfaceDrag=0,
    Buoyancy=1,
    PlasticThreshold=0,
    PlasticCreep=0,
    Wind=Vector(0, 0, 0),
    Drag=0,
    Lift=0,
    RelaxationMode=True,
    RelaxationFactor=1)
scene = FlexScene(Particles=flatten(particles))
opts = FlexSolverOptions(
    TimeStep=Slider(0.04, range=1e-05..0.2),
    SubSteps=3,
    NumIterations=3,
    SceneMode=number_slider_10,
    FixedNumberOfIteration=-1,
    MemoryRequirements=[131072, 96, 65536, 65536, 65536, 65536, 65536, 196608, 131972],
    StabilityScale=1)
preview_spheres = BooleanToggle(False)

flip_faces = BooleanToggle(False)
vec_4 = VectorXYZ(XComponent=expr("x*0.7", 0), YComponent=expr("x*0.7", 0), ZComponent=expr("x*0.7", 0))  # -> Vector, Length
msphereex = MeshSphereEx(Base=PlaneXY(0, 0, 0), Radius=Slider(100, range=0..200), Count=5)
move_4 = Move(Geometry=msphereex, Motion=vec_4.Vector)  # -> Geometry, Transform

# ----
# Triangulate & Clean Up
tri = Triangulate(Mesh=move_4.Geometry)  # -> Mesh, Count

weld = WeldMesh(Mesh=tri.Mesh, Angle=3.141592654)

# ----
# Flip Face Directions
demesh = DeconstructMesh(Mesh=weld)  # -> Vertices, Faces, Colours, Normals
deface = DeconstructFace(Face=demesh.Faces)  # -> CornerA, CornerB, CornerC, CornerD
triangle = MeshTriangle(CornerA=deface.CornerA, CornerB=deface.CornerC, CornerC=deface.CornerB)
conmesh = ConstructMesh(Vertices=demesh.Vertices, Faces=triangle)

filter = StreamFilter(Gate=flip_faces, Stream1=conmesh)

facen = FaceNormals(Mesh=filter)  # -> Centers, Normals
preview = CustomPreview(Geometry=filter, Shader=ColourSwatch(SwatchColor=RGBA(0, 0, 0, 32)))
vdis = VectorDisplay(Anchor=facen.Centers, Vector=expr("x*10", facen.Normals))
collgeometry = FlexCollisionGeometry(CollisionPlanes=flatten(pln), CollisionBoxes=flatten(box), CollisionMeshes=flatten(filter))
flex = FlexEngine(
    FlexParams=parameters,
    FlexCollisionGeometry=collgeometry,
    FlexScene=flatten(scene),
    FlexSolverOptions=opts,
    Reset=Button(),
    Go=Toggle(True))  # -> FlexObject, Information
gate = StreamGate(Stream=flex.FlexObject, Gate=preview_spheres)  # -> Target0, Target1
particles_2 = GetParticleDescription(FlexObject=flex.FlexObject, N=1)  # disabled

# ----
# Visualisation
allparts = GetAllParticles(FlexObject=gate.Target1, N=1)  # -> Points, Vector
detail = Slider(6, range=2..8)
msphereex_2 = MeshSphereEx(Base=allparts.Points, Radius=expr("x*0.5", number_slider_5), Count=detail)
msphereex_3 = MeshSphereEx(Base=allparts.Points, Radius=expr("x*0.5", number_slider_6), Count=detail)
msphereex_4 = MeshSphereEx(Base=allparts.Points, Radius=number_slider_7, Count=detail)
msphereex_5 = MeshSphereEx(Base=allparts.Points, Radius=number_slider_8, Count=detail)
msphereex_6 = MeshSphereEx(Base=allparts.Points, Radius=number_slider_9, Count=detail)
preview_2 = CustomPreview(Geometry=msphereex_2, Shader=ColourSwatch(SwatchColor=RGBA(0, 187, 255, 169)))
preview_3 = CustomPreview(Geometry=msphereex_3, Shader=ColourSwatch(SwatchColor=RGBA(255, 0, 0, 200)))
preview_4 = CustomPreview(Geometry=msphereex_4, Shader=ColourSwatch(SwatchColor=RGBA(255, 82, 82, 98)))
preview_5 = CustomPreview(Geometry=msphereex_5, Shader=ColourSwatch(SwatchColor=RGB(255, 251, 0)))
preview_6 = CustomPreview(Geometry=msphereex_6, Shader=ColourSwatch(SwatchColor=RGBA(255, 253, 122, 84)))

allparts_2 = GetAllParticles(FlexObject=gate.Target0, N=1)  # -> Points, Vector
cloud = CloudDisplay(Points=allparts_2.Points, Colours=ColourSwatch(SwatchColor=RGB(58, 164, 240)), Size=2, SpriteType=0)
