# Grasshopper definition 026_FLEXHOPPER.gh (Grasshopper 1.0.7)
# plug-ins: FlexHopper, Weaverbird, Bifocals

# ----
# CAREFUL!
# go slow one this one
# complexity grows
# quadratically with increased level
number_slider = Slider(3, range=1..15)

mesh = Mesh(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)
wbtriangles = WeaverbirdsSplitTrianglesSubdivision(MeshCurves=mesh, Level=number_slider)
tri = Triangulate(Mesh=wbtriangles)  # -> Mesh, Count
weld = WeldMesh(Mesh=tri.Mesh, Angle=3.141592654)
mesh_2 = Mesh(weld)
anchors = Point([Point(-15, -15, 0), Point(15, -15, 0), Point(15, 15, 0), Point(-15, 15, 0)])
vec = VectorXYZ(XComponent=Slider(0, range=0..100), YComponent=0, ZComponent=Slider(52.6, range=0..100))  # -> Vector, Length
move = Move(Geometry=mesh_2, Motion=graft(vec.Vector))  # -> flatten(Geometry), Transform
move_2 = Move(Geometry=anchors, Motion=graft(vec.Vector))  # -> Geometry, Transform
item = ListItem(List=move_2.Geometry, Index=[0, 1, 2], Wrap=True)

# ----
# CAREFUL!
# go slow one this one
# complexity grows
# quadratically with increased level
number_slider_2 = Slider(3, range=1..15)  # disabled

mesh_3 = Mesh(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)  # disabled
wbtriangles_2 = WeaverbirdsSplitTrianglesSubdivision(MeshCurves=mesh_3, Level=number_slider_2)  # disabled
tri_2 = Triangulate(Mesh=wbtriangles_2)  # -> Mesh, Count; disabled
number_slider_3 = Slider(52.6, range=0..100)  # disabled
number_slider_4 = Slider(0, range=0..100)  # disabled
weld_2 = WeldMesh(Mesh=tri_2.Mesh, Angle=3.141592654)  # disabled
mesh_4 = Mesh(weld_2)  # disabled
anchors_2 = Point([Point(-15, -15, 0), Point(15, -15, 0), Point(15, 15, 0), Point(-15, 15, 0)])  # disabled
vec_2 = VectorXYZ(XComponent=number_slider_4, YComponent=0, ZComponent=number_slider_3)  # -> Vector, Length; disabled
move_3 = Move(Geometry=mesh_4, Motion=graft(vec_2.Vector))  # -> flatten(Geometry), Transform; disabled
move_4 = Move(Geometry=anchors_2, Motion=graft(vec_2.Vector))  # -> Geometry, Transform; disabled
item_2 = ListItem(List=move_4.Geometry, Index=[0, 1, 2], Wrap=True)  # disabled

vec_3 = VectorXYZ(XComponent=Slider(-20, range=-20..20), YComponent=Slider(5, range=-20..20), ZComponent=Slider(0, range=-20..20))  # -> Vector, Length
pt = ConstructPoint(XCoordinate=0, YCoordinate=0, ZCoordinate=Slider(48.17, range=0..50))
item_3 = ListItem(List=move_2.Geometry, Index=[3, 1], Wrap=True)
sph = Sphere(Base=pt, Radius=Slider(5.244, range=0..30))
number_slider_5 = Slider(0.284, range=0..1)
number_slider_6 = Slider(0.209, range=0..1)
number_slider_7 = Slider(0.1, range=0..1)

# ----
# Wickerson's Favorite .gh Scripts
# from FLEXHOPPER
# Right click me to save
# params to .xml
# Alternatively use
# "FlexParameters from .xml file"
# which is more neat
# Play with me!
number_slider_8 = Slider(0, range=-10..10)
vec_4 = VectorXYZ(XComponent=number_slider_8, YComponent=0, ZComponent=Slider(-8.92, range=-10..10))  # -> Vector, Length
parameters = FlexParametersFromValues(
    Gravity=vec_4.Vector,
    Radius=number_slider_5,
    SolidRestDistance=expr("x*0.8", number_slider_5),
    FluidRestDistance=expr("x*0.9", number_slider_5),
    CollisionDistance=0.075,
    ParticleCollisionMargin=expr("x/2", 0.5),
    ShapeCollisionMargin=0.5,
    MaxSpeed=3.402823466e+38,
    MaxAcceleration=1000,
    DynamicFriction=number_slider_6,
    StaticFriction=number_slider_6,
    ParticleFriction=expr("x*0.2", number_slider_6),
    Restitution=0,
    Adhesion=0,
    SleepThreshold=0,
    ShockPropagation=0,
    Dissipation=0,
    Damping=0,
    Fluid=True,
    Viscosity=0,
    Cohesion=Slider(0.018, range=0..100),
    SurfaceTension=0,
    SolidPressure=1,
    FreeSurfaceDrag=0,
    Buoyancy=1,
    PlasticThreshold=0,
    PlasticCreep=0,
    Wind=vec_3.Vector,
    Drag=Slider(0.091, range=0..1),
    Lift=Slider(0.083, range=0..1),
    RelaxationMode=True,
    RelaxationFactor=1)

demesh = DeconstructMesh(Mesh=move_3.Geometry)  # -> Vertices, Faces, Colours, Normals; disabled

xy = XYPlane(Origin=Point(0, 0, 0))
collgeometry = FlexCollisionGeometry(CollisionPlanes=flatten(xy), CollisionSpheres=flatten(sph))

opts = FlexSoverOptions(
    TimeStep=Slider(0.02, range=0..0.2),
    SubSteps=Slider(5, range=1..30),
    NumIterations=Slider(5, range=1..10),
    SceneMode=0,
    FixedNumberOfIteration=-1,
    MemoryRequirements=[131072, 96, 65536, 65536, 65536, 65536, 65536, 196608, 131972],
    StabilityScale=1)

number_slider_9 = Slider(0.775, range=0..1)  # disabled

item_4 = ListItem(List=move_4.Geometry, Index=[3, 1], Wrap=True)  # disabled
cloth = ClothFromMesh(
    ClothMeshes=move.Geometry,
    StretchStiffness=1,
    BendingStiffness=0,
    SelfCollision=False,
    PreTension=1,
    Anchors=item,
    GroupIndex="0")
cp = ClosestPoint(Point=item_4, Cloud=demesh.Vertices)  # -> ClosestPoint, CPIndex, Distance; disabled
panel = Panel("""0
143""")  # disabled
number_slider_10 = Slider(-0.25, range=-3..10)  # disabled
number_slider_11 = Slider(1, range=0..3)  # disabled
medges = MeshEdges(Mesh=move_3.Geometry)  # -> NakedEdges, InteriorEdges, NonManifoldEdges; disabled
panel_2 = Panel(cp.CPIndex)  # disabled
springs = ConstraintsSprings(SpringPairIndices=panel, TargetSpringLength=number_slider_10)  # disabled
number_slider_12 = Slider(11.081, range=0..100)  # disabled
scene = FlexScene(Cloths=flatten(cloth))
len = Length(Curve=medges.InteriorEdges)  # disabled
number_slider_13 = Slider(7, range=1..10)  # disabled
number_slider_14 = Slider(7, range=1..10)  # disabled
panel_3 = Panel("0")  # disabled
number_slider_15 = Slider(0, range=0..2)  # disabled
cloth_2 = ClothFromMesh(
    ClothMeshes=move_3.Geometry,
    StretchStiffness=1,
    BendingStiffness=0,
    SelfCollision=False,
    PreTension=1,
    Anchors=item_2,
    GroupIndex=panel_3)  # disabled
avr = Average(Input=len)  # disabled
panel_4 = Panel(avr)  # disabled
multiplication = Multiplication(A=panel_4, B=number_slider_11)  # disabled
pt_2 = ConstructPoint(XCoordinate=0, YCoordinate=0, ZCoordinate=0)  # disabled
number_slider_16 = Slider(1, range=0..1)  # disabled
panel_5 = Panel("0")  # disabled
panel_6 = Panel("1")  # disabled
vec_5 = VectorXYZ(XComponent=0, YComponent=number_slider_12, ZComponent=0)  # -> Vector, Length; disabled
anchor = ConstraintsAnchors(AnchorIndex=panel_5)  # disabled
particles = ParticlesFromPoints(Points=pt_2, GroupIndex=panel_6)  # disabled
panel_7 = Panel(scene)
parameters_2 = FlexParametersFromValues(
    Gravity=Vector(0, 0, -9.81),
    Radius=multiplication,
    SolidRestDistance=multiplication,
    FluidRestDistance=0.1,
    CollisionDistance=0.075,
    ParticleCollisionMargin=0.5,
    ShapeCollisionMargin=0.5,
    MaxSpeed=3.402823466e+38,
    MaxAcceleration=100,
    DynamicFriction=0,
    StaticFriction=0,
    ParticleFriction=0,
    Restitution=0,
    Adhesion=0,
    SleepThreshold=0,
    ShockPropagation=0,
    Dissipation=0,
    Damping=0,
    Fluid=True,
    Viscosity=0,
    Cohesion=0.025,
    SurfaceTension=0,
    SolidPressure=1,
    FreeSurfaceDrag=0,
    Buoyancy=1,
    PlasticThreshold=0,
    PlasticCreep=0,
    Wind=vec_5.Vector,
    Drag=number_slider_16,
    Lift=number_slider_16,
    RelaxationMode=True,
    RelaxationFactor=1)  # disabled
opts_2 = FlexSolverOptions(
    TimeStep=0.01666666667,
    SubSteps=number_slider_13,
    NumIterations=number_slider_14,
    SceneMode=number_slider_15,
    FixedNumberOfIteration=-1,
    MemoryRequirements=[131072, 96, 65536, 65536, 65536, 65536, 65536, 196608, 131972],
    StabilityScale=1)  # disabled
scene_2 = FlexScene(Particles=flatten(particles), Cloths=flatten(cloth_2), LocalConstraints=flatten([anchor, springs]))  # disabled
button = Button()  # disabled
toggle = BooleanToggle(False)  # disabled

go = BooleanToggle(True)
reset = Button()

flex = FlexEngine(
    FlexParams=parameters,
    FlexCollisionGeometry=collgeometry,
    FlexScene=flatten(scene),
    FlexSolverOptions=opts,
    Reset=reset,
    Go=go)  # -> FlexObject, Information
flex_2 = FlexEngine(FlexParams=parameters_2, FlexScene=flatten(scene_2), FlexSolverOptions=opts_2, Reset=button, Go=toggle)  # -> FlexObject, Information; disabled
panel_8 = Panel(flex.Information)
material = CreateMaterial(Diffuse=RGB(255, 105, 180), Specular=RGB(255, 255, 255), Emission=RGB(0, 0, 0), Transparency=0, Shine=0)
panel_9 = Panel(flex_2.Information)  # disabled

# ----
# Enable me if you need me
# as I slow down simulation
number_slider_17 = Slider(22, range=1..100)
allsprings = GetAllSprings(FlexObject=flex.FlexObject, N=number_slider_17)
preview = CustomPreview(Geometry=allsprings, Shader=ColourSwatch(SwatchColor=RGB(255, 255, 255)))

cloths = GetCloths(FlexObject=flex_2.FlexObject, N=1, ClothObject=cloth_2)  # -> Points, Vector, Meshes; disabled
allsprings_2 = GetAllSprings(FlexObject=flex_2.FlexObject, N=1)  # disabled

# ----
# Enable me if you need me
# as I slow down simulation
cloths_2 = GetCloths(FlexObject=flex.FlexObject, N=1, ClothObject=cloth, PreviewMaterial=material)  # -> Points, Vector, Meshes

allsprings_3 = GetAllSprings(FlexObject=flex.FlexObject, N=1)
bake = InstantBake(Objects=flatten(cloths_2.Meshes), LayerName="Default", MaterialName=material, ClearLayer=False)
