# Grasshopper definition 027_CATENARY.gh (Grasshopper 1.0.7)
# plug-ins: Weaverbird, Kangaroo Components, Bifocals

# Wickerson's Favorite .gh Scripts
# from KANGAROO
mesh = Mesh(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)
wbedges = MeshEdges(Mesh=mesh)
wbvertices = VerticesComponent(Mesh=mesh, Weld=True)
Z = UnitZ(Factor=Slider(-11.107, range=-50..50))
uforce = UnaryForce(Point=wbvertices, Force=Z)
springs = SpringsFromLine(
    Connection=wbedges,
    Stiffness=1000,
    Damping=10,
    RestLength=wbedges,
    Cutoff=0,
    CompressionFail=0,
    TensileFail=0,
    Plasticity=0)
pt = Point([Point(10, 10, 0), Point(10, 30, 0), Point(50, 30, 0), Point(50, 10, 0)])
timer = Timer(Interval=1, TimerInterval=5, Target=kangaroo)
kangaroo = KangarooPhysics(ForceObjects=flatten([springs, uforce]), AnchorPoints=pt, Settings=null, Geometry=mesh, SimulationReset=Toggle(False))  # -> Out, Iterations, ParticlesOut, GeometryOut, KE
mesh_2 = Mesh(kangaroo.GeometryOut)
