# Grasshopper definition 027_KANGAROO.gh (Grasshopper 1.0.7)
# plug-ins: Kangaroo Components, Bifocals, Kangaroo2 Components

mesh = Mesh(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)
# Wickerson's Favorite .gh Scripts
# from KANGAROO
number_slider = Slider(0.553, range=0..1)
clean = CombineClean(Meshes=mesh)
quaddiv = QuadDivide(Mesh=clean, Divisions=5)
springsfrommesh = SpringsFromMesh(M=quaddiv, stiffness=1000, B=number_slider)
nv = NakedVertices(Mesh=quaddiv)  # -> ClothedIndex, NakedIndex, ClothedPts, NakedPts

timer = Timer(Interval=20, TimerInterval=20, Target=kangaroo)  # disabled

point = Point(nv.NakedPts)
data = Data(springsfrommesh)
kangaroo = KangarooPhysics(ForceObjects=data, AnchorPoints=point, Settings=null, Geometry=quaddiv, SimulationReset=Toggle(False))  # -> Out, Iterations, ParticlesOut, GeometryOut, KE
mesh_2 = Mesh(kangaroo.GeometryOut)
mesh_edges = MeshEdges(Mesh=mesh_2)  # -> NakedEdges, InteriorEdges, NonManifoldEdges
merge = Merge(Data1=mesh_edges.NakedEdges, Data2=mesh_edges.InteriorEdges, Data3=mesh_edges.NonManifoldEdges)
multipipe = MultiPipe(Curves=merge, NodeSize=0.5, EndOffset=1, StrutSize=1, Segment=0, KinkAngle=0.6, CubeFit=0, Caps=0)

# ==== cluster SpringsFromMesh: Turns all edges of a mesh into springs
M = ClusterInput()
medges = MeshEdges(Mesh=M)  # -> NakedEdges, InteriorEdges, NonManifoldEdges
crv = Curve([medges.NakedEdges, medges.InteriorEdges])
B = ClusterInput()
len = Length(Curve=crv)
multiplication = Multiplication(A=len, B=B)
stiffness = ClusterInput()
springs = SpringsFromLine(Connection=crv, Stiffness=stiffness, Damping=10, RestLength=multiplication, UpperCutoff=0, LowerCutoff=0, Plasticity=0)
S = ClusterOutput(springs)
