# Grasshopper definition 028_KANGAROO.gh (Grasshopper 1.0.7)
# plug-ins: Kangaroo Components

# ---- group: struts
crv = Curve([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])

# ---- group: cables
crv_2 = Curve([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])

# ---- group: membrane
mesh = Mesh(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)

# ----
springs = SpringsFromLine(Connection=crv, Stiffness="3000", Damping=10, RestLength=crv, UpperCutoff=0, LowerCutoff=0, Plasticity=0)
springs_2 = SpringsFromLine(Connection=crv_2, Stiffness="50", Damping=10, RestLength=0, UpperCutoff=0, LowerCutoff=0, Plasticity=0)
# Separate the internal and
# external edges of the mesh
medges = MeshEdges(Mesh=mesh)  # -> NakedEdges, InteriorEdges, NonManifoldEdges
# Assigning the edge cables a rest length
# less than their starting length gives them
# a pre-tension
len = Length(Curve=medges.NakedEdges)
multiplication = Multiplication(A=Slider(0.729, range=0..1), B=len)

timer = Timer(Interval=1, TimerInterval=5, Target=kangaroo)

springs_3 = SpringsFromLine(
    Connection=medges.NakedEdges,
    Stiffness="500",
    Damping=10,
    RestLength=multiplication,
    UpperCutoff=0,
    LowerCutoff=0,
    Plasticity=0)
springs_4 = SpringsFromLine(Connection=medges.InteriorEdges, Stiffness="10", Damping=10, RestLength=0, UpperCutoff=0, LowerCutoff=0, Plasticity=0)

# ---- group: anchors
pt = Point([Point(7.221825407, 27.77817459, 0), Point(22.77817459, 12.22182541, 0), Point(7, 12, 0), Point(19, 16, 0), Point(11, 24, 0), Point(23, 28, 0)])

# ----
# Entwine then Explode to
# keep Geometry organized
entwine = Entwine(Branch00=mesh, Branch01=crv, Branch02=crv_2, FlattenInputs=True)
kangaroo = KangarooPhysics(
    ForceObjects=flatten([springs_2, springs, springs_3, springs_4]),
    AnchorPoints=pt,
    Settings=null,
    Geometry=entwine,
    SimulationReset=Button())  # -> Out, Iterations, ParticlesOut, GeometryOut, KE
bang = ExplodeTree(Data=kangaroo.GeometryOut)  # -> Branch0, Branch1, Branch2
pipe = Pipe(Curve=bang.Branch1, Radius=0.1, Caps=0)
mesh_2 = Mesh(bang.Branch0)
crv_3 = Curve(bang.Branch2)
