# Grasshopper definition 041_KANGAROO.gh (Grasshopper 1.0.7)
# plug-ins: Kangaroo Components, Bifocals

folding = Slider(0.205, range=0..1)
angle = Panel("pi")
angle_2 = Panel("-pi/2")

# ---- group: Mountain fold lines
crv = Curve([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])

# ---- group: mesh of flat folding pattern
# Wickerson's Favorite .gh Scripts
# from KANGAROO
mesh = Mesh(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)

# ---- group: Valley fold lines
crv_2 = Curve([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])

# ----
origami = Origami(mesh=mesh, C=crv_2, num_4=angle_2, C_2=crv, num_2=angle, num=folding)  # -> data_2, R
# just double click the kangaroo to launch the timer control
kangaroo = KangarooPhysics(ForceObjects=origami.data_2, Settings=null, Geometry=origami.R, SimulationReset=True)  # -> Out, Iterations, ParticlesOut, GeometryOut, KE
medges = MeshEdges(Mesh=kangaroo.GeometryOut)  # -> NakedEdges, InteriorEdges, NonManifoldEdges
preview = CustomPreview(
    Geometry=kangaroo.GeometryOut,
    Shader={diffuse=RGB(192, 192, 192), emission=RGB(0, 0, 0), shine=0.5, specular=RGB(255, 255, 255), transparency=0})

# ==== cluster Origami: Fold a flat pattern into 3d origami
mesh = ClusterInput()
mesh_2 = Mesh(mesh)
num = ClusterInput()
num_2 = ClusterInput()
hingepoints = HingePoints(Mesh=mesh_2)  # -> _1, _2, _3, _4
strength = Panel("1")
num_3 = Number(num)
C = ClusterInput()
C_2 = ClusterInput()
num_4 = ClusterInput()
strength_2 = Panel("1")
num_5 = Number(num_2)
num_6 = Number(strength)
eval = EvaluateCurve(Curve=reparameterize(C), Parameter=0.5)  # -> Point, Tangent, Angle
eval_2 = EvaluateCurve(Curve=reparameterize(C_2), Parameter=0.5)  # -> Point, Tangent, Angle
ln = Line(StartPoint=hingepoints._1, EndPoint=hingepoints._2)
num_7 = Number(num_4)
num_8 = Number(strength_2)
tri = Triangulate(Mesh=mesh_2)  # -> Mesh, Count
multiplication = Multiplication(A=num_7, B=num_3)
multiplication_2 = Multiplication(A=num_5, B=num_3)
eval_3 = EvaluateCurve(Curve=reparameterize(ln), Parameter=0.5)  # -> graft(Point), Tangent, Angle
springsfrommesh = SpringsFromMesh(M=tri.Mesh, stiffness=100, B=1)
planarizequads = PlanarizeQuads(M=mesh_2, planarizestrength=1000)
unweld = UnweldMesh(Mesh=mesh_2, Angle=0)
cp = ClosestPoint(Point=eval_3.Point, Cloud=eval_2.Point)  # -> ClosestPoint, CPIndex, Distance
cp_2 = ClosestPoint(Point=eval_3.Point, Cloud=eval.Point)  # -> ClosestPoint, CPIndex, Distance
R = ClusterOutput(unweld)
larger = LargerThan(FirstNumber=0.01, SecondNumber=cp.Distance)  # -> LargerThan, OrEqualTo
larger_2 = LargerThan(FirstNumber=0.01, SecondNumber=cp_2.Distance)  # -> LargerThan, OrEqualTo
cull = CullPattern(List=num_8, CullPattern=larger_2.LargerThan)
cull_2 = CullPattern(List=multiplication, CullPattern=larger_2.LargerThan)
cull_3 = CullPattern(List=num_6, CullPattern=larger.LargerThan)
cull_4 = CullPattern(List=multiplication_2, CullPattern=larger.LargerThan)
addition = Addition(A=cull, B=cull_3)
addition_2 = Addition(A=cull_2, B=cull_4)
addition_3 = Addition(A=0, B=addition)  # -> flatten(Result)
addition_4 = Addition(A=0, B=addition_2)  # -> flatten(Result)
hinge = Hinge(
    Point1=hingepoints._1,
    Point2=hingepoints._2,
    Point3=hingepoints._3,
    Point4=hingepoints._4,
    Strength=addition_3,
    RestAngle=addition_4)
data = Data([springsfrommesh, hinge, planarizequads])
data_2 = ClusterOutput(data)

# ==== cluster PlanarizeQuads: Applies a planarization force to any quads in a mesh
M = ClusterInput()
mcomp = Decompose(Mesh=M)  # -> Vertices, Faces, Colours, Normals
vertices = FaceVertices(Face=mcomp.Faces)  # -> CornerA, CornerB, CornerC, CornerD
planarizestrength = ClusterInput()
item = ListItem(List=mcomp.Vertices, Index=vertices.CornerA, Wrap=False)
item_2 = ListItem(List=mcomp.Vertices, Index=vertices.CornerB, Wrap=False)
item_3 = ListItem(List=mcomp.Vertices, Index=vertices.CornerC, Wrap=False)
item_4 = ListItem(List=mcomp.Vertices, Index=vertices.CornerD, Wrap=False)
planarize = Planarize(Point1=item, Point2=item_2, Point3=item_3, Point4=item_4, PlanarizeStrength=planarizestrength)
equals = Equality(FirstNumber=vertices.CornerC, SecondNumber=vertices.CornerD)  # -> Equality, Inequality
cull = CullPattern(List=planarize, CullPattern=equals.Inequality)
L = ClusterOutput(cull)

# ==== cluster SpringsFromMesh: Turns all edges of a mesh into springs
M = ClusterInput()
medges = MeshEdges(Mesh=M)  # -> NakedEdges, InteriorEdges, NonManifoldEdges
crv = Curve([medges.NakedEdges, medges.InteriorEdges])
B = ClusterInput()
len = Length(Curve=crv)
multiplication = Multiplication(A=len, B=B)
stiffness = ClusterInput()
springs = SpringsFromLine(Connection=crv, Stiffness=stiffness, Damping=10, RestLength=multiplication, UpperCutoff=0, LowerCutoff=0, Plasticity=0)
S = ClusterOutput(springs)
