# Grasshopper definition 042_KANGAROO.gh (Grasshopper 1.0.7)
# plug-ins: Weaverbird, Kangaroo Components, Bifocals

# Wickerson's Favorite .gh Scripts
# from KANGAROO
mesh = Mesh(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)
wbstellate = WeaverbirdsStellateCumulation(MeshPolylines=mesh, Distance="0")
meshpressure = MeshPressure(M=wbstellate, pressurelevel=15)
springsfrommesh = SpringsFromMesh(M=wbstellate, stiffness=1000, B=1)

timer = Timer(Interval=20, TimerInterval=20, Target=kangaroo)

kangaroo = KangarooPhysics(ForceObjects=[meshpressure, springsfrommesh], Settings=null, Geometry=wbstellate, SimulationReset=Toggle(False))  # -> Out, Iterations, ParticlesOut, GeometryOut, KE
mesh_2 = Mesh(kangaroo.GeometryOut)
preview = CustomPreview(Geometry=mesh_2, Shader=ColourSwatch(SwatchColor=RGB(15, 207, 255)))

# ==== cluster MeshPressure: Applies pressure to a triangulated mesh
M = ClusterInput()
mcomp = Decompose(Mesh=M)  # -> Vertices, Faces, Colours, Normals
vertices = FaceVertices(Face=mcomp.Faces)  # -> CornerA, CornerB, CornerC, CornerD
item = ListItem(List=mcomp.Vertices, Index=vertices.CornerA, Wrap=False)
item_2 = ListItem(List=mcomp.Vertices, Index=vertices.CornerB, Wrap=False)
item_3 = ListItem(List=mcomp.Vertices, Index=vertices.CornerC, Wrap=False)
pressurelevel = ClusterInput()
pressure = Pressure(Point1=item, Point2=item_2, Point3=item_3, PressureLevel=pressurelevel)
P = ClusterOutput(pressure)

# ==== cluster SpringsFromMesh: Turns all edges of a mesh into springs
M = ClusterInput()
medges = MeshEdges(Mesh=M)  # -> NakedEdges, InteriorEdges, NonManifoldEdges
crv = Curve([medges.NakedEdges, medges.InteriorEdges])
B = ClusterInput()
len = Length(Curve=crv)
multiplication = Multiplication(A=len, B=B)
stiffness = ClusterInput()
springs = SpringsFromLine(Connection=crv, Stiffness=stiffness, Damping=10, RestLength=multiplication, UpperCutoff=0, LowerCutoff=0, Plasticity=0)
S = ClusterOutput(springs)
