# Grasshopper definition 044_KANGAROO.gh (Grasshopper 1.0.7)
# plug-ins: Kangaroo Components, Mesh Pipe, Fologram For Grasshopper Utilities

# Here every ring interacts with every other one. For larger meshes it would be worth setting it up to only interact ones that are actually linked
crv = Curve([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])
crossref = CrossReference(ListA=crv, ListB=crv, CrossMode=5)  # -> ListA, ListB
range = Range(Domain=Domain(0, 1), Steps=10)
shatter = Shatter(Curve=reparameterize(crv), Parameters=range)
shatter_2 = Shatter(Curve=reparameterize(crossref.ListA), Parameters=range)
shatter_3 = Shatter(Curve=reparameterize(crossref.ListB), Parameters=range)
end = EndPoints(Curve=shatter)  # -> Start, End
# Wickerson's Favorite .gh Scripts
# from KANGAROO
shift = ShiftList(List=end.Start, Shift=0, Wrap=True)
shift_2 = ShiftList(List=end.Start, Shift=1, Wrap=True)
shift_3 = ShiftList(List=end.Start, Shift=2, Wrap=True)
shift_4 = ShiftList(List=end.Start, Shift=3, Wrap=True)
crossref_2 = CrossReference(ListA=shatter_2, ListB=shatter_3, CrossMode=1)  # -> ListA, ListB
mirror = Mirror(A=shift_2, B=shift, C=shift_4, D=shift_3, MirrorStrength=1000)
end_2 = EndPoints(Curve=crossref_2.ListA)  # -> Start, End
end_3 = EndPoints(Curve=crossref_2.ListB)  # -> Start, End
ln = Line(StartPoint=end.Start, EndPoint=end.End)
uforce = UnaryForce(Point=end.Start, Force=Vector(0, 0, -4))
offset = Offset(1.8)
join = JoinCurves(Curves=ln, Preserve=True)
crv_2 = Curve(ln)
lineline = LineLine(
    L1Start=end_2.Start,
    L1End=end_2.End,
    L2Start=end_3.Start,
    L2End=end_3.End,
    Strength=1000,
    UpperCutoff=offset,
    LowerCutoff=0,
    Offset=offset,
    Exponent=1)
polylinebend = PolyLineBend(polyline=flatten(join), bendstrength=2000, B=1)  # -> L, B_2
springs = SpringsFromLine(Connection=crv_2, Stiffness=4000, Damping=10, RestLength=crv_2, UpperCutoff=0, LowerCutoff=0, Plasticity=0)
pt = Point([Point(51, 8, 0), Point(25, 8, 0)])
number_slider = Slider(0.25, range=0..1)

timer = Timer(Interval=20, TimerInterval=20, Target=kangaroo)

kangaroo_settings = KangarooSettings(
    Tolerance=0.001,
    TimeStep=0.01,
    SubIterations=10,
    Floor=False,
    Drag=1,
    Restitution=0.7,
    StaticFriction=10,
    KineticFriction=10,
    Settle=2,
    Tumble=1,
    Sound=False,
    Solver=0)
kangaroo = KangarooPhysics(
    ForceObjects=flatten([lineline, springs, uforce, polylinebend.B_2, mirror]),
    AnchorPoints=pt,
    Settings=kangaroo_settings,
    Geometry=join,
    SimulationReset=Button())  # -> Out, Iterations, ParticlesOut, GeometryOut, KE
crv_3 = Curve(kangaroo.GeometryOut)
mpipe = MeshPipe(Curve=crv_3, Radius=expr("R/2", offset), Accuracy=0.2, Rotation=0, Segments=10, Caps=2)
mesh_pipe = MeshPipe(Polylines=crv_3, NumberOfSides=Slider(4, range=0..10), Tolerance=0.1, Radius=offset, Cap=False, Join=False)

# ==== cluster PolyLineBend: PolyLineBend
polyline = ClusterInput()
polyline_2 = Curve(polyline)
cls = Closed(Curve=polyline_2)  # -> Closed, Periodic
explode = Explode(Curve=polyline_2, Recursive=True)  # -> Segments, Vertices
split = SplitList(List=explode.Vertices, Index=1)  # -> ListA, ListB
shift = ShiftList(List=explode.Vertices, Shift=0, Wrap=False)
shift_2 = ShiftList(List=explode.Vertices, Shift=1, Wrap=False)
shift_3 = ShiftList(List=explode.Vertices, Shift=2, Wrap=False)
shift_4 = ShiftList(List=split.ListB, Shift=0, Wrap=True)
shift_5 = ShiftList(List=split.ListB, Shift=1, Wrap=True)
shift_6 = ShiftList(List=split.ListB, Shift=2, Wrap=True)
filter = StreamFilter(Gate=cls.Closed, Stream0=shift_3, Stream1=shift_6)
filter_2 = StreamFilter(Gate=cls.Closed, Stream0=shift_2, Stream1=shift_5)
filter_3 = StreamFilter(Gate=cls.Closed, Stream0=shift, Stream1=shift_4)
short = ShortList(ListA=filter_3, ListB=filter_2, TrimMode=2)  # -> ListA, ListB
short_2 = ShortList(ListA=filter_3, ListB=filter_2, ListC=filter, TrimMode=2)  # -> ListA, ListB, ListC
ln = Line(StartPoint=short.ListA, EndPoint=short.ListB)
L = ClusterOutput(ln)
vec2pt = Vector2Pt(PointA=short_2.ListA, PointB=short_2.ListB, Unitize=False)  # -> Vector, Length
vec2pt_2 = Vector2Pt(PointA=short_2.ListB, PointB=short_2.ListC, Unitize=False)  # -> Vector, Length
angle = Angle(VectorA=vec2pt.Vector, VectorB=vec2pt_2.Vector)  # -> Angle, Reflex
B = ClusterInput()
multiplication = Multiplication(A=angle.Angle, B=B)
bendstrength = ClusterInput()
bend = Bend(Point1=short_2.ListA, Point2=short_2.ListB, Point3=short_2.ListC, BendStrength=bendstrength, RestAngle=multiplication)
B_2 = ClusterOutput(bend)
