# Grasshopper definition 045_KANGAROO.gh (Grasshopper 1.0.7)
# plug-ins: Kangaroo Components, Bifocals

mesh = Mesh(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)
# Wickerson's Favorite .gh Scripts
# from KANGAROO
number_slider = Slider(630, range=0..1000)
kangaroo_settings = KangarooSettings(
    Tolerance=0.001,
    TimeStep=0.01,
    SubIterations=10,
    Floor=True,
    Drag=1,
    Restitution=0.7,
    StaticFriction=10,
    KineticFriction=10,
    Settle=2,
    Tumble=1,
    Sound=False,
    Solver=0)
demesh = DeconstructMesh(Mesh=mesh)  # -> Vertices, Faces, Colours, Normals
list_item = ListItem(List=demesh.Vertices, Index=number_slider, Wrap=True)
springsfrommesh = SpringsFromMesh(M=mesh, stiffness=1000, B=1)
uforce = UnaryForce(Point=demesh.Vertices, Force=Vector(0, 0, -9.8))
sc = SphereCollide(Centers=demesh.Vertices, Radius=0.5)
point = Point(list_item)
kangaroo = KangarooPhysics(
    ForceObjects=flatten([sc, uforce, springsfrommesh]),
    AnchorPoints=point,
    Settings=kangaroo_settings,
    Geometry=mesh,
    SimulationReset=Toggle(False))  # -> Out, Iterations, ParticlesOut, GeometryOut, KE
mesh_2 = Mesh(kangaroo.GeometryOut)

# ==== cluster SpringsFromMesh: Turns all edges of a mesh into springs
M = ClusterInput()
medges = MeshEdges(Mesh=M)  # -> NakedEdges, InteriorEdges, NonManifoldEdges
crv = Curve([medges.NakedEdges, medges.InteriorEdges])
B = ClusterInput()
len = Length(Curve=crv)
multiplication = Multiplication(A=len, B=B)
stiffness = ClusterInput()
springs = SpringsFromLine(Connection=crv, Stiffness=stiffness, Damping=10, RestLength=multiplication, UpperCutoff=0, LowerCutoff=0, Plasticity=0)
S = ClusterOutput(springs)
