# Grasshopper definition 046_KANGAROO.gh (Grasshopper 1.0.7)
# plug-ins: Kangaroo Components, Bifocals

weight = Slider(0.211, range=0..1)
# from KANGAROO
crv = Curve([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])
neg = Negative(Value=weight)
end = EndPoints(Curve=graft(crv))  # -> Start, End
len = Length(Curve=graft(crv))
# Wickerson's Favorite .gh Scripts
springs = SpringsFromLine(Connection=crv, Stiffness=1000, Damping=10, RestLength=crv, UpperCutoff=0, LowerCutoff=0, Plasticity=0)
Z = UnitZ(Factor=neg)
multiplication = Multiplication(A=len, B=Z)
uforce = UnaryForce(Point=[end.Start, end.End], Force=multiplication)
pt = Point([Point(4.998392989, 5, 31.21320344), Point(4.998392989, 0, 31.21320344), Point(5, 5, 10), Point(5, 0, 10)])
# Convert a Point to a Vector and add to
# the Geometry input to get the resultant
# force acting on that point as an output.
vec = Vector(pt)

timer = Timer(Interval=20, TimerInterval=20, Target=kangaroo)

entwine = Entwine(Branch00=crv, Branch01=pt, Branch02=vec, FlattenInputs=True)
# Entwine then Explode to
# keep Geometry organized
kangaroo = KangarooPhysics(ForceObjects=flatten([uforce, springs]), AnchorPoints=pt, Settings=null, Geometry=entwine, SimulationReset=Toggle(False))  # -> Out, Iterations, ParticlesOut, GeometryOut, KE
bang = ExplodeTree(Data=kangaroo.GeometryOut)  # -> Branch0, Branch1, Branch2
number_slider = Slider(0.021, range=0..1)
rev = Reverse(Vector=bang.Branch2)
len_2 = Length(Curve=crv)
len_3 = Length(Curve=bang.Branch0)
multiplication_2 = Multiplication(A=rev, B="0.1")
subtraction = Subtraction(A=len_3, B=len_2)
neg_2 = Negative(Value=number_slider)
vdis = VectorDisplay(Anchor=bang.Branch1, Vector=multiplication_2)
gradient = Gradient(
    LowerLimit=neg_2,
    UpperLimit=number_slider,
    Parameter=subtraction,
    stops=[0: RGB(39, 72, 161), 0.254: RGB(1, 192, 229), 0.503: RGB(79, 186, 8), 0.755: RGB(220, 237, 32), 1: RGB(243, 57, 0)])
preview = CustomPreview(Geometry=bang.Branch0, Shader=gradient)
