# Grasshopper definition 048_CHRISTEV.gh (Grasshopper 1.0.7)
# plug-ins: Bifocals

# Wickerson's Favorite .gh Scripts
# from CHRISTEV
number_slider = Slider(6, range=0..6)
number_slider_2 = Slider(9, range=0..1000)
curve = Curve(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)
polygon = Polygon(Plane=PlaneXY(0, 0, 0), Radius=3, Segments=number_slider, FilletRadius=0)  # -> Polygon, Length
pipe_variable = PipeVariable(
    Curve=reparameterize(curve),
    Parameters=[Slider(0.401, range=0..1), Slider(0.14, range=0..1), Slider(0, range=0..1), Slider(0.655, range=0..1), Slider(1, range=0..1)],
    Radii=[Slider(4.342, range=0..12), Slider(5.988, range=0..12), Slider(10.591, range=0..12), Slider(3.555, range=0..12), Slider(6.169, range=0..12)],
    Caps=0)
triangular = Triangular(Plane=PlaneXY(0, 0, 0), Size=1, ExtentX=number_slider_2, ExtentY=number_slider_2)  # -> flatten(Cells), Points
bounding_box = BoundingBox(Content=triangular.Cells, Plane=PlaneXY(0, 0, 0), UnionBox=True)  # -> Box, Box_2
map_to_surface = MapToSurface(Curve=triangular.Cells, Source=bounding_box.Box, Target=pipe_variable)
explode = Explode(Curve=map_to_surface, Recursive=True)  # -> Segments, Vertices
cull_index = CullIndex(List=explode.Vertices, Indices=-1, Wrap=True)
average = Average(Input=cull_index)
explode_2 = Explode(Curve=explode.Segments, Recursive=True)  # -> Segments, Vertices
curve_closest_point = CurveClosestPoint(Point=average, Curve=curve)  # -> Point, Parameter, Distance
average_2 = Average(Input=explode_2.Vertices)
bounds = Bounds(Numbers=flatten(curve_closest_point.Distance))
shift_paths = ShiftPaths(Data=average_2, Offset=-1)
construct_domain = ConstructDomain(DomainStart=Slider(0.542, range=0..1), DomainEnd=Slider(0.428, range=0..1))
surface_closest_point = SurfaceClosestPoint(Point=average, Surface=pipe_variable)  # -> Point, UVPoint, Distance
number_slider_3 = Slider(0.416, range=0..1)
line = Line(StartPoint=average, EndPoint=shift_paths)
remap_numbers = RemapNumbers(Value=curve_closest_point.Distance, Source=bounds, Target=construct_domain)  # -> Mapped, Clipped
evaluate_surface = EvaluateSurface(Surface=pipe_variable, Point=surface_closest_point.UVPoint)  # -> Point, Normal, UDirection, VDirection, Frame
evaluate_curve = EvaluateCurve(Curve=reparameterize(line), Parameter=remap_numbers.Mapped)  # -> Point, Tangent, Angle
deconstruct_plane = DeconstructPlane(Plane=evaluate_surface.Frame)  # -> Origin, XAxis, YAxis, ZAxis
negative = Negative(Value=number_slider_3)
line_2 = Line(StartPoint=graft(evaluate_curve.Point), EndPoint=explode_2.Vertices)
amplitude = Amplitude(Vector=deconstruct_plane.ZAxis, Amplitude=[number_slider_3, negative])
shift_paths_2 = ShiftPaths(Data=line_2, Offset=-1)
move = Move(Geometry=average, Motion=amplitude)  # -> Geometry, Transform
join_curves = JoinCurves(Curves=shift_paths_2, Preserve=False)
extrude_point = ExtrudePoint(Base=join_curves, Point=move.Geometry)
panel = Panel(join_curves)
brep_join = BrepJoin(Breps=extrude_point)  # -> Breps, Closed
