# Grasshopper definition 049_CHRISTEV.gh (Grasshopper 1.0.7)

# Wickerson's Favorite .gh Scripts
# from CHRISTEV
# Single Phase Sine Curve
number_slider = Slider(4, range=0..100)
# Single Phase Cos Curve
number_slider_2 = Slider(4, range=0..100)
pi = Pi(Factor=number_slider)
pi_2 = Pi(Factor=number_slider_2)
dom = ConstructDomain(DomainStart=0, DomainEnd=pi)
dom_2 = ConstructDomain(DomainStart=0, DomainEnd=pi_2)
range = Range(Domain=dom, Steps=Slider(128, range=0..128))
range_2 = Range(Domain=dom_2, Steps=Slider(128, range=0..128))
pi_3 = Pi(Factor=Slider(0, range=0..4))
pi_4 = Pi(Factor=Slider(0, range=0..4))
expression = Expression(A=Slider(5, range=0..10), t=range, x=pi_3, w=Slider(1, range=0..2), Expression="A*sin(w*t+x)")
expression_2 = Expression(A=Slider(5, range=0..10), t=range_2, x=pi_4, w=Slider(1, range=0..2), Expression="A*cos(w*t+x)")
pt = ConstructPoint(XCoordinate=range, YCoordinate=Slider(6, range=0..10), ZCoordinate=expression)
pt_2 = ConstructPoint(XCoordinate=range_2, YCoordinate=Slider(6, range=0..10), ZCoordinate=expression_2)
intcrv = Interpolate(Vertices=pt, Degree=3, Periodic=False, KnotStyle=1)  # -> Curve, Length, Domain
intcrv_2 = Interpolate(Vertices=pt_2, Degree=3, Periodic=False, KnotStyle=1)  # -> Curve, Length, Domain
