# Grasshopper definition 050_CHRISTEV.gh (Grasshopper 1.0.7)
# plug-ins: Bifocals

# Wickerson's Favorite .gh Scripts
# from CHRISTEV
number_slider = Slider(39.377, range=0..60)
number_slider_2 = Slider(0.468, range=0..1)
# Correct Parametric Sphere
number_slider_3 = Slider(60, range=0..60)
number_slider_4 = Slider(0.8, range=0..1)
pi = Pi(Factor=Slider(1.557, range=0..2))
pi_2 = Pi(Factor=Slider(5.544, range=0..20))
pi_3 = Pi(Factor=Slider(9.087, range=0..20))
pi_4 = Pi(Factor=number_slider_4)
pi_5 = Pi(Factor=number_slider_4)
construct_domain = ConstructDomain(DomainStart=0, DomainEnd=pi)
construct_domain_2 = ConstructDomain(DomainStart=0, DomainEnd=pi_2)
construct_domain_3 = ConstructDomain(DomainStart=0, DomainEnd=pi_3)
multiplication = Multiplication(A=pi_4, B=Slider(2, range=0..2))
negative = Negative(Value=pi_5)
negative_2 = Negative(Value=multiplication)
number_slider_5 = Slider(25, range=0..360)
range = Range(Domain=construct_domain, Steps=Slider(360, range=0..360))
range_2 = Range(Domain=construct_domain_2, Steps=Slider(141, range=0..360))
range_3 = Range(Domain=construct_domain_3, Steps=Slider(272, range=0..360))
construct_domain_4 = ConstructDomain(DomainStart=negative, DomainEnd=pi_5)
construct_domain_5 = ConstructDomain(DomainStart=0, DomainEnd=negative_2)
expression = Expression(r=number_slider, t=range_3, Expression="13*cos(t)-5*cos(2*t)-2-cos(4*t)")
range_4 = Range(Domain=construct_domain_5, Steps=number_slider_5)
range_5 = Range(Domain=construct_domain_4, Steps=Slider(24, range=0..360))
expression_2 = Expression(r=number_slider, t=range_3, Expression="16*(sin(t)^3)")
expression_3 = Expression(r=number_slider, t=range, Expression="r*cos(t)")
expression_4 = Expression(r=number_slider, t=range, Expression="r*sin(t)")
expression_5 = Expression(r=number_slider, t=range_2, Expression="t*cos(t)")
expression_6 = Expression(r=number_slider, t=range_2, Expression="t*sin(t)")
cross_reference = CrossReference(ListListA=range_5, ListListB=range_4, CrossMode=1)  # -> ListListA, ListListB
construct_point = ConstructPoint(XCoordinate=expression_3, YCoordinate=expression_4, ZCoordinate=0)
construct_point_2 = ConstructPoint(XCoordinate=expression_5, YCoordinate=expression_6, ZCoordinate=range_2)
construct_point_3 = ConstructPoint(XCoordinate=expression_2, YCoordinate=expression, ZCoordinate=range_3)
expression_7 = Expression(r=number_slider_3, u=cross_reference.ListListA, v=cross_reference.ListListB, Expression="r*cos(u)* cos(v)")
expression_8 = Expression(r=number_slider_3, u=cross_reference.ListListA, v=cross_reference.ListListB, Expression="r*sin(u)* cos(v)")
expression_9 = Expression(r=number_slider_3, u=cross_reference.ListListA, v=cross_reference.ListListB, Expression="r*sin(v)")
interpolate = Interpolate(Vertices=construct_point_2, Degree=3, Periodic=False, KnotStyle=1)  # -> Curve, Length, Domain
interpolate_2 = Interpolate(Vertices=construct_point, Degree=3, Periodic=False, KnotStyle=1)  # -> Curve, Length, Domain
interpolate_3 = Interpolate(Vertices=construct_point_3, Degree=3, Periodic=False, KnotStyle=1)  # -> Curve, Length, Domain
construct_point_4 = ConstructPoint(XCoordinate=expression_7, YCoordinate=expression_8, ZCoordinate=expression_9)
expression_10 = Expression(u=number_slider_5, Expression="u+1")
surface_from_points = SurfaceFromPoints(Points=construct_point_4, UCount=expression_10, Interpolate=False)
