# Grasshopper definition 062_HOOPSNAKE_Co-de-iT.gh (Grasshopper 1.0.7)
# plug-ins: HoopSnake

# Koch Snowflake with Hoopsnake.
# 
# A definition that draws a 2D koch snowflake fractal using the Hoopsnake component.
# 
# © Co-de-iT 2013
panel = Panel("3")
polygon = Polygon(Plane=PlaneXY(0, 0, 0), Radius=3, Segments=panel, FilletRadius=0)  # -> Polygon, Length
# Wickerson's Favorite .gh Scripts
# from HOOPSNAKE
explode = Explode(Curve=polygon.Polygon, Recursive=True)  # -> Segments, Vertices
rad = Radians(Degrees="-60")
rad_2 = Radians(Degrees="60")
max_iterations_number = Slider(5, range=0..7)
expression = Expression(x=max_iterations_number, Expression="3^x")
divide = DivideCurve(Curve=hs.Feedback, Count="3", Kinks=False)  # -> Points, Tangents, Parameters
item = ListItem(List=divide.Points, Index="0", Wrap=False)
item_2 = ListItem(List=divide.Points, Index="2", Wrap=False)
item_3 = ListItem(List=divide.Points, Index="3", Wrap=False)
item_4 = ListItem(List=divide.Points, Index="1", Wrap=False)
ln = Line(StartPoint=item_4, EndPoint=item_2)
ln_2 = Line(StartPoint=item, EndPoint=item_4)
rotate = Rotate(Geometry=ln, Angle=rad, Plane=item_4)  # -> Geometry, Transform
rotate_2 = Rotate(Geometry=ln, Angle=rad_2, Plane=item_2)  # -> Geometry, Transform
ln_3 = Line(StartPoint=item_2, EndPoint=item_3)
merge = Merge(Data1=ln_2, Data2=rotate.Geometry, Data3=rotate_2.Geometry, Data4=ln_3)
hs = HoopSnake(
    StartingData=explode.Segments,
    Data=merge,
    TerminationCondition=larger.OrEqualTo,
    Hoopsnake_Data_autoUpdate=False,
    Hoopsnake_Data_dataLimit=2147483647,
    Hoopsnake_Data_delay=0,
    Hoopsnake_Data_resetCounter=True,
    Hoopsnake_Data_updateView=True)  # -> Feedback, LoopsCounter, IterationsCounter, IterationsCounter_2
join = JoinCurves(Curves=flatten(hs.Feedback), Preserve=False)
lng = ListLength(List=flatten(hs.Feedback))
preview = CustomPreview(Geometry=join, Shader=ColourSwatch(SwatchColor=RGB(255, 255, 255)))
larger = LargerThan(FirstNumber=expression, SecondNumber=lng)  # -> LargerThan, OrEqualTo
