# Grasshopper definition 063_Phyllotaxis_MODLABS.gh (Grasshopper 1.0.7)
# plug-ins: Bifocals

# Wickerson's Favorite .gh Scripts
# Phyllotaxis from MODLABS
# rt click on item and click help
# x=cos(t)*t
# y=sin(t)*t
# the series is t, must be expressed and put into x and y
# Point List tool provides #'s
# disable point preview
# Toggle Tool True/False not available anymore
# Cull Pattern
# with Panel of TFTF
number_slider = Slider(146, range=10..200)
# Voronoi
# search on Mathworld
# Charlotte May
# ______
# Gate
# Dispatching
# 
# 
# Modulus checks for remainders to find patterns
# (need to look into this more)
number_slider_2 = Slider(146, range=10..200)
not = GateNot()
dispatch = Dispatch(DispatchPattern=[True, False])  # -> ListA, ListB

# ---- group: t
series = Series(Start=0, Step=1, Count=number_slider_2)

series_2 = Series(Start=0, Step=1, Count=number_slider)

# ----
expression = Expression(t=series, Expression="cos(t)*t")
expression_2 = Expression(t=series, Expression="sin(t)*t")
expression_3 = Expression(t=series_2, Expression="cos(t)*t")
expression_4 = Expression(t=series_2, Expression="sin(t)*t")
panel = Panel("""true
false
false""")
pt = ConstructPoint(XCoordinate=expression, YCoordinate=expression_2, ZCoordinate=0)
pt_2 = ConstructPoint(XCoordinate=expression_3, YCoordinate=expression_4, ZCoordinate=0)
panel_2 = Panel("""true
false
false""")
mod = Modulus()
points = PointList(Points=pt)

# ---- group: culled list of points
cull = CullPattern(List=pt, CullPattern=panel)

# ----
points_2 = PointList(Points=pt_2)

# ---- group: culled list of points
cull_2 = CullPattern(List=pt_2, CullPattern=panel_2)

# ----
interpolate = Interpolate(Vertices=cull, Degree=3, Periodic=False, KnotStyle=1)  # -> Curve, Length, Domain

# ---- group: Google: "voronoi"
voronoi = Voronoi(Points=cull, Radius=Slider(20, range=0..40), BruteForceOverride=False)
