# Grasshopper definition 064_MODLABS.gh (Grasshopper 1.0.7)
# plug-ins: Bifocals

# Wickerson's Favorite .gh Scripts
# from MODLABS
number_slider = Slider(3.936, range=1..4)
# Point Polar
# Range
# Pi
# Number of Pi
# Into xy plane
# Golden Mean into d (offset)
# Convert Degrees in to Radians
# Create a surface from lines not Points
# ------
# Spline Curves
# Planar and NonPlanar
# Point on curve Analysis
number_slider_2 = Slider(29, range=1..100)
pi = Pi(Factor=number_slider)

# ---- group: t
range = Range(Domain=pi, Steps=number_slider_2)

# ----
radians = Radians(Degrees=Slider(60, range=0..60))
golden_ratio = GoldenRatio(Factor=range)

# ---- group: planar
point_polar = PointPolar(BasePlane=PlaneXY(0, 0, 0), XYAngle=range, ZAngle=0, Offset=golden_ratio)

# ---- group: NonPlanar
point_polar_2 = PointPolar(BasePlane=PlaneXY(0, 0, 0), XYAngle=range, ZAngle=radians, Offset=golden_ratio)

# ----
nurbs_curve = NurbsCurve(Vertices=point_polar, Degree=3, Periodic=False)  # -> Curve, Length, Domain
nurbs_curve_2 = NurbsCurve(Vertices=point_polar_2, Degree=3, Periodic=False)  # -> Curve, Length, Domain

# ---- group: Connecting Points
line = Line(StartPoint=point_polar, EndPoint=point_polar_2)

# ----
point_on_curve = PointOnCurve(nurbs_curve.Curve, parameter=0.766)
panel = Panel(point_on_curve)
cull_index = CullIndex(List=line, Indices="0", Wrap=True)
loft = Loft(Curves=cull_index, Options={Adjust=False, Closed=False, LoftEnds=0, LoftSimp=0, LoftType=0, Rebuild=10, Refit=0.01})
