# Grasshopper definition 065_OM!.gh (Grasshopper 1.0.7)
# plug-ins: Bifocals

# from OM!
number_slider = Slider(50, range=0..100)
# Wickerson's Favorite .gh Scripts
construct_point = ConstructPoint(XCoordinate=0, YCoordinate=0, ZCoordinate=0)
construct_point_2 = ConstructPoint(XCoordinate=0, YCoordinate=0, ZCoordinate=number_slider)
circle = Circle(Plane=[construct_point, construct_point_2], Radius=[Slider(10, range=0..10), Slider(9, range=0..10)])
divide_curve = DivideCurve(Curve=circle, Count=Slider(20, range=0..100), Kinks=False)  # -> Points, Tangents, Parameters
number_slider_2 = Slider(6, range=0..10)
explode_tree = ExplodeTree(Data=divide_curve.Points)  # -> Branch0, Branch1
negative = Negative(Value=number_slider_2)
shift_list = ShiftList(List=explode_tree.Branch1, Shift=number_slider_2, Wrap=True)
shift_list_2 = ShiftList(List=explode_tree.Branch1, Shift=negative, Wrap=True)
line = Line(StartPoint=explode_tree.Branch0, EndPoint=shift_list)
divide_curve_2 = DivideCurve(Curve=line, Count=10, Kinks=False)  # -> Points, Tangents, Parameters
line_2 = Line(StartPoint=explode_tree.Branch0, EndPoint=shift_list_2)
flip_matrix = FlipMatrix(Data=divide_curve_2.Points)
interpolate = Interpolate(Vertices=flip_matrix, Degree=3, Periodic=Toggle(True), KnotStyle=1)  # -> Curve, Length, Domain
pipe = Pipe(Curve=[interpolate.Curve, line_2, line], Radius=Slider(0.5, range=0..1), Caps=0)
boundary_surfaces = BoundarySurfaces(Edges=interpolate.Curve)
brep_edges = BrepEdges(Brep=[boundary_surfaces, pipe])  # -> Naked, Interior, NonManifold
