# Grasshopper definition 066_OM!.gh (Grasshopper 1.0.7)
# plug-ins: Bifocals

# set one raise warped
# surface from Rhino
curve = Curve([<curve referenced from the Rhino model> x2])
loft = Loft(Curves=curve, Options={Adjust=False, Closed=False, LoftEnds=0, LoftSimp=0, LoftType=0, Rebuild=10, Refit=0.01})
number_slider = Slider(4, range=0..15)
surface = Surface(loft)
# Wickerson's Favorite .gh Scripts
# from OM!
md_slider = MDSlider(
    SliderMode=0,
    slider_value=Point(0.5828861144, 0.6543738668, 0.5),
    x_domain=Domain(0, 1),
    y_domain=Domain(0, 1),
    z_domain=Domain(0, 1))
divide_domain² = DivideDomain²(Domain=surface, UCount=Slider(3, range=0..15), VCount=number_slider)
isotrim = Isotrim(Surface=surface, Domain=divide_domain²)
deconstruct_brep = DeconstructBrep(Brep=isotrim)  # -> Faces, Edges, Vertices
evaluate_surface = EvaluateSurface(Surface=reparameterize(deconstruct_brep.Faces), Point=md_slider)  # -> Point, Normal, UDirection, VDirection, Frame
reverse = Reverse(Vector=evaluate_surface.Normal)
line_sdl = LineSDL(Start=evaluate_surface.Point, Direction=reverse, Length=Slider(26.732, range=0..100))
end_points = EndPoints(Curve=line_sdl)  # -> Start, End
point = Point(flatten(end_points.End))
partition_list = PartitionList(List=point, Size=number_slider)
flip_matrix = FlipMatrix(Data=partition_list)
interpolate = Interpolate(Vertices=partition_list, Degree=3, Periodic=False, KnotStyle=1)  # -> Curve, Length, Domain
interpolate_2 = Interpolate(Vertices=flip_matrix, Degree=3, Periodic=False, KnotStyle=1)  # -> Curve, Length, Domain
line = Line(StartPoint=end_points.End, EndPoint=deconstruct_brep.Vertices)
curve_2 = Curve(deconstruct_brep.Edges)
pipe = Pipe(Curve=[interpolate_2.Curve, interpolate.Curve, line, curve_2], Radius=Slider(0.79, range=0..1), Caps=0)
