# Grasshopper definition 067_OM!.gh (Grasshopper 1.0.7)
# plug-ins: Bifocals

quad_sphere = QuadSphere(Base=PlaneXY(0, 0, 0), Radius=Slider(100, range=0..100))
deconstruct_brep = DeconstructBrep(Brep=quad_sphere)  # -> Faces, Edges, Vertices
# Wickerson's Favorite .gh Scripts
# from OM!
# Must make the general shape of the stadium in rhino first
# select surface!
list_item = ListItem(List=deconstruct_brep.Faces, Index=0, Wrap=True)
construct_point = ConstructPoint(XCoordinate=0, YCoordinate=0, ZCoordinate=0)
surface = Surface(list_item)
sphere = Sphere(Base=construct_point, Radius=Slider(52, range=0..100))
populate_3d = Populate3D(Region=sphere, Count=Slider(30, range=0..100), Seed=1)
vector_2pt = Vector2Pt(PointA=construct_point, PointB=populate_3d, Unitize=False)  # -> Vector, Length
number_slider = Slider(0.9, range=0..1)
plane_normal = PlaneNormal(Origin=construct_point, ZAxis=vector_2pt.Vector)
brep_plane = BrepPlane(Brep=surface, Plane=plane_normal)  # -> Curves, Points
offset_surface = OffsetSurface(Surface=surface, Distance=number_slider, Retrim=True)
clean_tree = CleanTree(RemoveNulls=True, RemoveInvalid=True, RemoveEmpty="1", Tree=brep_plane.Curves)
offset_on_srf = OffsetOnSrf(Curve=clean_tree, Distance=number_slider, Surface=offset_surface)  # -> graft(Curve)
panel = Panel(clean_tree)
surface_split = SurfaceSplit(Surface=surface, Curves=flatten(clean_tree))
weave = Weave(Pattern=[0, 1], Stream0=graft(clean_tree), Stream1=offset_on_srf, NullGaps=False)
loft = Loft(Curves=weave, Options={Adjust=False, Closed=False, LoftEnds=0, LoftSimp=0, LoftType=0, Rebuild=10, Refit=0.01})
brep_wireframe = BrepWireframe(Brep=surface_split, Density=-1)
offset_surface_2 = OffsetSurface(Surface=loft, Distance=number_slider, Retrim=True)
join_curves = JoinCurves(Curves=brep_wireframe, Preserve=False)
divide_curve = DivideCurve(Curve=join_curves, Count=10, Kinks=False)  # -> Points, Tangents, Parameters
brep_wireframe_2 = BrepWireframe(Brep=loft, Density=-1)
brep_wireframe_3 = BrepWireframe(Brep=offset_surface_2, Density=-1)
average = Average(Input=divide_curve.Points)
weave_2 = Weave(Pattern=[0, 1], Stream0=graft(brep_wireframe_2), Stream1=graft(brep_wireframe_3), NullGaps=False)
loft_2 = Loft(Curves=weave_2, Options={Adjust=False, Closed=False, LoftEnds=0, LoftSimp=0, LoftType=0, Rebuild=10, Refit=0.01})
deconstruct_vector = DeconstructVector(Vector=average)  # -> XComponent, YComponent, ZComponent
shift_paths = ShiftPaths(Data=loft_2, Offset=-1)
larger_than = LargerThan(FirstNumber=deconstruct_vector.ZComponent, SecondNumber=Slider(81.41, range=0..200))  # -> LargerThan, OrEqualTo
weave_3 = Weave(Pattern=[0, 1], Stream0=shift_paths, Stream1=loft, Stream2=offset_surface_2, NullGaps=False)
cull_pattern = CullPattern(List=surface_split, CullPattern=flatten(larger_than.LargerThan))
brep_join = BrepJoin(Breps=weave_3)  # -> Breps, Closed
