# Grasshopper definition 068_RHINO_FORUM.gh (Grasshopper 1.0.7)

# Wickerson's Favorite .gh Scripts
# from RHINO FORUM
button = Button()
c_script = CSharpScript(TestMyDefinition=button)  # -> out, Result
# ---------- c_script: C# ----------
    int count = GrasshopperDocument.ObjectCount;
    string result = "Wow, a negative amount of components.You must be Chuck Norris!";
    if (count >= 0) result = "Dummy, you need at least 2 additional components to compete here!";
    if (count > 3) result = "Only the Dark Lord (Peter F.) should have such a short definition, thats why he wears a mask and a voice scrambler";
    if (count > 10) result = "Your definition length is below average. You are a loft failure!";
    if (count > 100) result = "Your definition length is average, next time try to create more components not control points";
    if (count > 500) result = "Your definition length is above average, Seems like you know whats 'Copy and Paste' is all about!";
    if (count > 1000) result = "Great! Your definition is big. You have a 50 % chance of being part of the top 1% or you just doing jewellery design?";
    if (count > 2000) result = "Awesome, your definition is large. Now you are ready to build extremly useful definitions!";
    if (count > 3000) result = "Legendary! You must building kiteboards and kites,competing against $10000-per-seat software?";
    if (count > 23000) result = "NBBJ, my friend! Only the longest definition-writer get a payed internship as architect";
    Result = result;
# ---------- end c_script ----------
panel = Panel(c_script.Result)
