# Grasshopper definition 069_WEAVERBIRD.gh (Grasshopper 1.0.7)
# plug-ins: Weaverbird, LunchBox, Kangaroo2 Components

brep = Brep(<brep referenced from the Rhino model>)
mesh_brep = MeshBrep(
    Brep=brep,
    Settings={GridMaxCount=0, GridMinCount=16, JaggedSeams=False, MaxEdgeLength=0, MinEdgeLength=0.0001, MinTolerance=0, Refine=True, RefineAngle=0, RelativeTolerance=0.65, SimplePlanes=True, Tolerance=0})
mesh_reduce = MeshReduce(Mesh=mesh_brep, TargetSize=Slider(251, range=0..1000), Distort=True, Accuracy=5, NormalizeSize=False)
number_slider = Slider(2, range=0..5)
number_slider_2 = Slider(1, range=0..5)
mesh = Mesh(mesh_reduce)
weaverbird_s_loop_subdivision = WeaverbirdsLoopSubdivision(MeshCurves=mesh, Level=number_slider_2, SmoothNakedEdges=1)
weaverbird_s_catmull_clark_subdivision = WeaverbirdsCatmullClarkSubdivision(MeshCurves=mesh, Level=number_slider_2, SmoothNakedEdges=1)
weaverbird_s_constant_quads_split_subdiv = WeaverbirdsConstantQuadsSplitSubdivision(MeshCurves=mesh, Level=number_slider_2, SmoothNakedEdges=1)

number_slider_3 = Slider(1.45, range=0..10)

weaverbird_s_picture_frame = WeaverbirdsPictureFrame(
    MeshPolylines=weaverbird_s_catmull_clark_subdivision,
    Distance=[Slider(21, range=0..100), Slider(38, range=0..100), Slider(20, range=0..100)],
    InsetType=0)
weaverbird_s_mesh_thicken = WeaverbirdsMeshThicken(MeshCurves=weaverbird_s_picture_frame, Distance=[Slider(0.13, range=0..10), Slider(0.54, range=0..10)], OffsetType=0)
weaverbird_s_catmull_clark_subdivision_2 = WeaverbirdsCatmullClarkSubdivision(MeshCurves=weaverbird_s_mesh_thicken, Level=Slider(2, range=1..3), SmoothNakedEdges=1)
construct_point = ConstructPoint(XCoordinate=0, YCoordinate=0, ZCoordinate=0)
geometry = Geometry()
contour = Contour(
    Shape=weaverbird_s_catmull_clark_subdivision_2,
    Point=construct_point,
    Direction=Vector(0, 0, 1),
    Distance=Slider(1.88, range=0..10))
area = Area(Geometry=contour)  # -> Area, Centroid
interpolate = Interpolate(Vertices=area.Centroid, Degree=3, Periodic=False, KnotStyle=1)  # -> Curve, Length, Domain
multipipe = MultiPipe(
    Curves=[contour, interpolate.Curve],
    NodeSize=Slider(0.2, range=0..1),
    EndOffset=1,
    StrutSize=1,
    Segment=0,
    KinkAngle=0.6,
    CubeFit=0,
    Caps=0)
