# Grasshopper definition 070_ZOLLINGER_PATTERN.gh (Grasshopper 1.0.7)
# Copyright: Wickerson Studios
# plug-ins: Bifocals

# Wickerson Studio
# 
# created by: Michael Wickerson
# 
# Grasshopper for Rhino 3D Algorithmic Modeling
# 
# www.wickersonstudios.com
# www.michaelwickerson.com
# https://www.youtube.com/channel/UC7J48Ppcsa6oncp6d29R0xw
# https://github.com/mwickerson
# https://www.facebook.com/michael.wickerson
# https://www.linkedin.com/in/michael-wickerson-696a80156/
# Wickerson Studio
# created by: Michael Wickerson
# Grasshopper for Rhino 3D Algorithmic Modeling
# www.wickersonstudios.com
# www.michaelwickerson.com
# https://www.youtube.com/channel/UC7J48Ppcsa6oncp6d29R0xw
# https://github.com/mwickerson
# https://www.facebook.com/michael.wickerson
# https://www.linkedin.com/in/michael-wickerson-696a80156/
image_sampler = ImageSampler(Filter="Value", Interpolate=False, Umax=1, Umin=0, Vmax=1, Vmin=0, Wrap=1)
# https://discourse.mcneel.com/t/zollinger-pattern/92853/5
size = Slider(4.074, range=0..10)
number_slider = Slider(10, range=0..10)
panel = Panel("""False
True
True
False""")
panel_2 = Panel("""False
True""")
rectangle = Rectangle(Plane=PlaneXY(0, 0, 0), XSize=Slider(100, range=0..100), YSize=Slider(100, range=0..100), Radius=0)  # -> Rectangle, Length
repeat_data = RepeatData(Data=panel, Length=expr("(x+1)*2", number_slider))
divide_surface = DivideSurface(Surface=rectangle.Rectangle, UCount=number_slider, VCount=Slider(6, range=0..10))  # -> Points, Normals, Parameters
partition_list = PartitionList(List=repeat_data, Size=2)
construct_domain = Domain(DomainStart=expr("-x/2", size), DomainEnd=expr("x/2", size))
# https://www.notechmagazine.com/2016/07/lamella-roofs.html
cull_pattern = CullPattern(List=divide_surface.Points, CullPattern=partition_list)
# https://discourse.mcneel.com/t/zollinger-pattern/92853/5
rectangle_2 = Rectangle(Plane=cull_pattern, XSize=construct_domain, YSize=construct_domain, Radius=0)  # -> simplify(Rectangle), Length

# ---- group: cull by length
discontinuity = Discontinuity(Curve=rectangle_2.Rectangle, Level=1)  # -> Points, Parameters
line = Line(StartPoint=graft(discontinuity.Points), EndPoint=flatten(discontinuity.Points))
length = Length(Curve=line)  # -> expr("round(x,3)", Length)
create_set = CreateSet(List=flatten(length))  # -> Set, Map
sort_list = SortList(Keys=create_set.Set)  # -> Keys, ValuesValuesA
list_item = ListItem(List=sort_list.Keys, Index=Slider(7, range=3..40), Wrap=True)
equality = Equality(FirstNumber=length, SecondNumber=list_item)  # -> Equality, Inequality
cull_pattern_2 = CullPattern(List=line, CullPattern=equality.Equality)
custom_preview = CustomPreview(Geometry=cull_pattern_2, Shader=ColourSwatch(SwatchColor=RGB(0, 0, 255)))
